# Grasshopper definition design tool.gh (Grasshopper 1.0.7)
# plug-ins: ThermotionDesignTool4, Kangaroo2 Components, ThermotionSimulatorLinker, Human UI, Human, Mesh Pipe, MetaHopper, ThermotionSimulationSetter, ThermotionSimulatorStarter

# ---- group: Startbutton
button = Button()

# ----
c_script = CSharpScript()  # -> A
# ---------- c_script: C# ----------
    string str = string.Empty;
    str = System.IO.Directory.GetCurrentDirectory();
    A = str;
# ---------- end c_script ----------
panel = Panel(c_script)
or = GateOr(A=button, B=True)
launchwin = LaunchWindow(
    Show=or,
    Name="Thermotion Design Tool",
    Width=Slider(500, range=0..1000),
    Height=Slider(600, range=0..1000),
    ChildStatus=2,
    EnableHorizScroll=False)
winprops = SetWindowProperties(Window=launchwin, Theme=Slider(0, range=0..10), ShowTitleBar=True, ScaleFactor=1)

playbar = Slider(0, range=0..1000)
toggle = CreateToggle(Default=False, OnLabel="set view: thermography", OffLabel="set view: photography")
toggle_2 = CreateToggle(Default=False)
slider = CreateSlider(Slider=playbar, ShowBounds=False, ShowTicks=False, ShowTooltip=False, ShowValLabel=True, showLabel=True)
label = CreateLabel(LabelText="Record panel", LabelSize=18, Justification=0)
values = ValueListener(Elements=toggle, SomeProperty=True)  # -> Values, Indices
values_2 = ValueListener(Elements=toggle_2, SomeProperty=True)  # -> Values, Indices
values_3 = ValueListener(Elements=slider, SomeProperty=True)  # -> Values, Indices
merge = Merge(Data1=toggle_2, Data2=toggle)  # -> graft(Result)
panel_2 = Panel("""2*
3*""")
simplegrid = CreateSimpleGrid(UIElements=merge, RowDefinitions="Auto", ColumnDefinitions=panel_2)  # -> flatten(SimpleGrid)
merge_2 = Merge(Data1=label, Data2=simplegrid, Data3=slider)

label_2 = CreateLabel(LabelText="check points", LabelSize=12, Justification=0)
pickbtn = CreateRhinoPickButton(ButtonName="load points", Prompt="Please select geometry...", AllowMultiple=True, AllowNone=True, Type=0, ButtonStyle=0)
button_2 = CreateButton(ButtonName="preview", ButtonStyle=0)
values_4 = ValueListener(Elements=pickbtn, SomeProperty=True)  # -> Values, Indices
values_5 = ValueListener(Elements=button_2, SomeProperty=True)  # -> Values, Indices
python = GhPythonScript(x=values_4.Values, y="load points")  # -> a
# ---------- python: Python ----------
__author__ = "23776"
__version__ = "2023.02.03"

import rhinoscriptsyntax as rs

if x is None:
    a = y + " (null)";
else:
    a = y + " (√)"
# ---------- end python ----------
setbtn = SetButton(ButtonToModify=pickbtn, ButtonName=python)
merge_3 = Merge(Data1=label_2, Data2=pickbtn, Data3=button_2)  # -> graft(Result)
simplegrid_2 = CreateSimpleGrid(UIElements=merge_3, RowDefinitions="Auto", ColumnDefinitions="Auto")  # -> flatten(SimpleGrid)

heat_diffusion_layer_thickness_mm = Slider(0.05, range=0..0.1)
environment_temperature_c = Slider(26.1, range=0..100)
panel_3 = Panel("Advanced Parameters")
channel_layer_thickness_mm = Slider(0.5, range=0..1)
textbox = CreateTextBox(Label="C_w", DefaultText="70", UpdateButton=Toggle(False), showLabel=True)
textbox_2 = CreateTextBox(Label="B_dissipation", DefaultText="220", UpdateButton=Toggle(False), showLabel=True)
textbox_3 = CreateTextBox(Label="A_dissipation", DefaultText="7", UpdateButton=Toggle(False), showLabel=True)
toggle_3 = CreateToggle(Default=True, OnLabel="heat diffusion layer", OffLabel="heat diffusion layer")
textbox_4 = CreateTextBox(Label="C_ab", DefaultText="2800", UpdateButton=Toggle(False), showLabel=True)
panel_4 = Panel("k")
values_6 = ValueListener(Elements=textbox, SomeProperty=True)  # -> Values, Indices
values_7 = ValueListener(Elements=textbox_3, SomeProperty=True)  # -> Values, Indices
values_8 = ValueListener(Elements=textbox_4, SomeProperty=True)  # -> Values, Indices
values_9 = ValueListener(Elements=textbox_2, SomeProperty=True)  # -> Values, Indices
values_10 = ValueListener(Elements=toggle_3, SomeProperty=True)  # -> Values, Indices
slider_2 = CreateSlider(
    Slider=environment_temperature_c,
    ShowBounds=False,
    ShowTicks=False,
    ShowTooltip=False,
    ShowValLabel=True,
    showLabel=True)
textbox_5 = CreateTextBox(Label="k(W/m*K)", DefaultText=Slider(0.13, range=0..0.5), UpdateButton=Toggle(False), showLabel=True)
textbox_6 = CreateTextBox(Label="c(J/kg*K)", DefaultText=Slider(550, range=0..1000), UpdateButton=Toggle(False), showLabel=True)
textbox_7 = CreateTextBox(Label="c(J/kg*K)", DefaultText=Slider(390, range=0..1000), UpdateButton=Toggle(False), showLabel=True)
slider_3 = CreateSlider(
    Slider=heat_diffusion_layer_thickness_mm,
    ShowBounds=False,
    ShowTicks=False,
    ShowTooltip=False,
    ShowValLabel=True,
    showLabel=True)
textbox_8 = CreateTextBox(Label="k(W/m*K)", DefaultText=Slider(400, range=0..1000), UpdateButton=Toggle(False), showLabel=True)
textbox_9 = CreateTextBox(Label="ρ(kg/m^3)", DefaultText=Slider(1300, range=0..3000), UpdateButton=Toggle(False), showLabel=True)
textbox_10 = CreateTextBox(Label="ρ(kg/m^3)", DefaultText=Slider(8960, range=0..10000), UpdateButton=Toggle(False), showLabel=True)
slider_4 = CreateSlider(
    Slider=channel_layer_thickness_mm,
    ShowBounds=False,
    ShowTicks=False,
    ShowTooltip=False,
    ShowValLabel=True,
    showLabel=True)
merge_4 = Merge(Data1=textbox, Data2=textbox_4, Data3=textbox_3, Data4=textbox_2, Data5=toggle_3)  # -> graft(Result)
values_11 = ValueListener(Elements=slider_2, SomeProperty=True)  # -> Values, Indices
values_12 = ValueListener(Elements=slider_3, SomeProperty=True)  # -> Values, Indices
values_13 = ValueListener(Elements=slider_4, SomeProperty=True)  # -> Values, Indices
panel_5 = Panel("""1*
1*""")
merge_5 = Merge(Data1=textbox_6, Data2=textbox_9, Data3=textbox_5)
merge_6 = Merge(Data1=textbox_7, Data2=textbox_10, Data3=textbox_8)
label_3 = CreateLabel(LabelText="diffusion layer material", LabelSize=12, Justification=0)
label_4 = CreateLabel(LabelText="channel material", LabelSize=12, Justification=0)
merge_7 = Merge(Data1=slider_2)  # -> graft(Result)
simplegrid_3 = CreateSimpleGrid(UIElements=merge_4, RowDefinitions="Auto", ColumnDefinitions="Auto")  # -> flatten(SimpleGrid)
panel_6 = Panel("""1*
1*""")
merge_8 = Merge(Data1=slider_3)  # -> graft(Result)
panel_7 = Panel("""1*
1*""")
merge_9 = Merge(Data1=slider_4)  # -> graft(Result)
values_14 = ValueListener(Elements=merge_5, SomeProperty=True)  # -> flatten(Values), Indices
merge_10 = Merge(Data1=label_4, Data2=merge_5)  # -> graft(Result)
merge_11 = Merge(Data1=label_3, Data2=merge_6)  # -> graft(Result)
values_15 = ValueListener(Elements=merge_6, SomeProperty=True)  # -> flatten(Values), Indices
simplegrid_4 = CreateSimpleGrid(UIElements=merge_7, RowDefinitions="Auto", ColumnDefinitions=panel_5)
simplegrid_5 = CreateSimpleGrid(UIElements=merge_8, RowDefinitions="Auto", ColumnDefinitions=panel_6)
simplegrid_6 = CreateSimpleGrid(UIElements=merge_9, RowDefinitions="Auto", ColumnDefinitions=panel_7)
simplegrid_7 = CreateSimpleGrid(UIElements=merge_10, RowDefinitions="Auto", ColumnDefinitions=panel_5)
simplegrid_8 = CreateSimpleGrid(UIElements=merge_11, RowDefinitions="Auto", ColumnDefinitions=panel_5)
separator = CreateSeparator(Thickness=0.5, Horizontal=True, Color=ColourSwatch(SwatchColor=RGB(217, 217, 217)))
merge_12 = Merge(
    Data1=simplegrid_3,
    Data2=simplegrid_6,
    Data3=simplegrid_5,
    Data4=simplegrid_4,
    Data5=simplegrid_7,
    Data6=simplegrid_8,
    Data7=separator,
    Data8=simplegrid_2)  # -> graft(Result)

python_2 = GhPythonScript(x="Update and Save Configuration")  # -> a
# ---------- python_2: Python ----------
__author__ = "23776"
__version__ = "2023.02.03"

import rhinoscriptsyntax as rs

if y is None:
    a = x;
else:
    a = y;
# ---------- end python_2 ----------
button_3 = CreateButton(ButtonName=python_2, ButtonStyle=0)
values_16 = ValueListener(Elements=button_3, SomeProperty=True)  # -> Values, Indices
separator_2 = CreateSeparator(Thickness=0.5, Horizontal=True, Color=ColourSwatch(SwatchColor=RGB(217, 217, 217)))
merge_13 = Merge(Data1=separator_2, Data2=button_3)

groups = GetGroups()  # -> Groups, GroupStyles, Nickname, Color
gradient = Gradient(LowerLimit=0, UpperLimit=1, stops=[0: RGB(234, 38, 0), 1: RGB(255, 255, 255)])
gradient_2 = Gradient(LowerLimit=0, UpperLimit=1, stops=[0: RGB(255, 255, 255)])
groups_2 = GetGroups()  # -> Groups, GroupStyles, Nickname, Color
list = ItemSelector(
    groups.Nickname,
    {"", "display", "", "", "", "", "", "Data from before", "step4", "step5"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}, selected="painted color")
list_2 = ItemSelector(
    groups_2.Nickname,
    {"", "display", "", "", "", "", "", "Data from before", "step4", "step5"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}, selected="unpainted color")
textbox_11 = CreateTextBox(Label="max temp(°C)", DefaultText="45", UpdateButton=False, showLabel=True)
textbox_12 = CreateTextBox(Label="min temp(°C)", DefaultText="37", UpdateButton=False, showLabel=True)
label_5 = CreateLabel(LabelText="painted Area", LabelSize=12, Justification=0)
label_6 = CreateLabel(LabelText="set temperature-color mapping", LabelSize=12, Justification=0)
textbox_13 = CreateTextBox(Label="min temp(°C)", DefaultText="20", UpdateButton=False, showLabel=True)
label_7 = CreateLabel(LabelText="unpainted Area", LabelSize=12, Justification=0)
textbox_14 = CreateTextBox(Label="max temp(°C)", DefaultText="60", UpdateButton=False, showLabel=True)
gradient_3 = CreateGradientEditor(DefaultGradient=gradient, ShowEditor=True, ShowPresets=False)
values_17 = ValueListener(Elements=textbox_12, SomeProperty=True)  # -> Values, Indices
values_18 = ValueListener(Elements=textbox_11, SomeProperty=True)  # -> Values, Indices
gradient_4 = CreateGradientEditor(DefaultGradient=gradient_2, ShowEditor=True, ShowPresets=False)
values_19 = ValueListener(Elements=textbox_14, SomeProperty=True)  # -> Values, Indices
values_20 = ValueListener(Elements=textbox_13, SomeProperty=True)  # -> Values, Indices
merge_14 = Merge(Data1=textbox_12, Data2=textbox_11)  # -> graft(Result)
values_21 = ValueListener(Elements=gradient_3, SomeProperty=True)  # -> Values, Indices
fsim = FindSimilarMember(Data=list, Set=groups.Nickname)  # -> Hit, Index
fsim_2 = FindSimilarMember(Data=list_2, Set=groups_2.Nickname)  # -> Hit, Index
merge_15 = Merge(Data1=textbox_13, Data2=textbox_14)  # -> graft(Result)
item = ListItem(List=groups.Groups, Index=fsim.Index, Wrap=True)
values_22 = ValueListener(Elements=gradient_4, SomeProperty=True)  # -> Values, Indices
item_2 = ListItem(List=groups_2.Groups, Index=fsim_2.Index, Wrap=True)
simplegrid_9 = CreateSimpleGrid(UIElements=merge_14, RowDefinitions="Auto", ColumnDefinitions="1*")
simplegrid_10 = CreateSimpleGrid(UIElements=merge_15, RowDefinitions="Auto", ColumnDefinitions="1*")
objfromgroup = GetObjectsInGroup(Group=item)
objfromgroup_2 = GetObjectsInGroup(Group=item_2)
setobj = SetObjectValue(ObjectToSet=objfromgroup, ValueToSet=values_21.Values)
setobj_2 = SetObjectValue(ObjectToSet=objfromgroup_2, ValueToSet=values_22.Values)
merge_16 = Merge(Data1=label_7, Data2=flatten(simplegrid_10), Data3=gradient_4)  # -> flatten(Result)
merge_17 = Merge(Data1=label_5, Data2=flatten(simplegrid_9), Data3=gradient_3)  # -> flatten(Result)
entwine = Entwine(Branch00=merge_17, Branch01=merge_16, FlattenInputs=True)
simplegrid_11 = CreateSimpleGrid(UIElements=entwine, RowDefinitions="Auto", ColumnDefinitions="1*")
merge_18 = Merge(Data1=label_6, Data2=flatten(simplegrid_11))

label_8 = CreateLabel(LabelText="simulation surface", LabelSize=12, Justification=0)
pickbtn_2 = CreateRhinoPickButton(ButtonName="load mesh", Prompt="Please select geometry...", AllowMultiple=True, AllowNone=True, Type=0, ButtonStyle=0)
button_4 = CreateButton(ButtonName="preview", ButtonStyle=0)
merge_19 = Merge(Data1="TriMesh", Data2="QuadMesh")
values_23 = ValueListener(Elements=pickbtn_2, SomeProperty=True)  # -> Values, Indices
values_24 = ValueListener(Elements=button_4, SomeProperty=True)  # -> Values, Indices
pulldown = CreatePulldownMenu(Label="mesh type", ListItems=merge_19, showLabel=True)
python_3 = GhPythonScript(x=values_23.Values, y="load mesh")  # -> a; same code as python
values_25 = ValueListener(Elements=pulldown, SomeProperty=True)  # -> Values, Indices
setbtn_2 = SetButton(ButtonToModify=pickbtn_2, ButtonName=python_3)
python_4 = GhPythonScript(x="QuadMesh", y=values_25.Values)  # -> out, a
# ---------- python_4: Python ----------
__author__ = "busin"
__version__ = "2023.02.04"

import rhinoscriptsyntax as rs
if x == y:
    a = True
else:
    a = False
# ---------- end python_4 ----------
merge_20 = Merge(Data1=label_8, Data2=pickbtn_2, Data3=button_4, Data4=pulldown)  # -> graft(Result)
panel_8 = Panel("""1.1*
1.3*
0.8*
2*""")
simplegrid_12 = CreateSimpleGrid(UIElements=merge_20, RowDefinitions="Auto", ColumnDefinitions=panel_8)  # -> flatten(SimpleGrid)

merge_21 = Merge(Data1="polyline", Data2="mesh-like")
button_5 = CreateButton(ButtonName="Update Data", ButtonStyle=0)
label_9 = CreateLabel(LabelText="fluid layer", LabelSize=12, Justification=0)
button_6 = CreateButton(ButtonName="preview", ButtonStyle=0)
pulldown_2 = CreatePulldownMenu(Label="water type", ListItems=merge_21, showLabel=True)
values_26 = ValueListener(Elements=button_5, SomeProperty=True)  # -> Values, Indices
values_27 = ValueListener(Elements=button_6, SomeProperty=True)  # -> Values, Indices
values_28 = ValueListener(Elements=pulldown_2, SomeProperty=True)  # -> Values, Indices
python_5 = GhPythonScript(x="polyline", y=values_28.Values)  # -> out, a; same code as python_4
merge_22 = Merge(Data1=label_9, Data2=button_5, Data3=button_6, Data4=pulldown_2)  # -> graft(Result)
simplegrid_13 = CreateSimpleGrid(UIElements=merge_22, RowDefinitions="Auto", ColumnDefinitions=panel_8)  # -> flatten(SimpleGrid)

cut_index = Slider(0, range=0..5)
label_10 = CreateLabel(LabelText="heat diffusion layer", LabelSize=12, Justification=0)
pickbtn_3 = CreateRhinoPickButton(ButtonName="load mesh", Prompt="Please select geometry...", AllowMultiple=False, AllowNone=False, Type=0, ButtonStyle=0)
slider_5 = CreateSlider(Slider=cut_index, ShowBounds=False, ShowTicks=False, ShowTooltip=False, ShowValLabel=True, showLabel=True)
button_7 = CreateButton(ButtonName="preview", ButtonStyle=0)
values_29 = ValueListener(Elements=button_7, SomeProperty=True)  # -> Values, Indices
values_30 = ValueListener(Elements=slider_5, SomeProperty=True)  # -> Values, Indices
values_31 = ValueListener(Elements=pickbtn_3, SomeProperty=True)  # -> Values, Indices
python_6 = GhPythonScript(x=values_31.Values, y="load mesh")  # -> a
# ---------- python_6: Python ----------
__author__ = "23776"
__version__ = "2023.02.03"

import rhinoscriptsyntax as rs

if x is None:
    a = y + " (optional)";
else:
    a = y + " (√)"
# ---------- end python_6 ----------
setbtn_3 = SetButton(ButtonToModify=pickbtn_3, ButtonName=python_6)
merge_23 = Merge(Data1=label_10, Data2=pickbtn_3, Data3=button_7, Data4=slider_5)  # -> graft(Result)
simplegrid_14 = CreateSimpleGrid(UIElements=merge_23, RowDefinitions="Auto", ColumnDefinitions=panel_8)  # -> flatten(SimpleGrid)

cut_index_2 = Slider(0, range=0..5)
label_11 = CreateLabel(LabelText="painting layer", LabelSize=12, Justification=0)
pickbtn_4 = CreateRhinoPickButton(ButtonName="load mesh", Prompt="Please select geometry...", AllowMultiple=True, AllowNone=True, Type=0, ButtonStyle=0)
button_8 = CreateButton(ButtonName="preview", ButtonStyle=0)
slider_6 = CreateSlider(Slider=cut_index_2, ShowBounds=False, ShowTicks=False, ShowTooltip=False, ShowValLabel=True, showLabel=True)
values_32 = ValueListener(Elements=pickbtn_4, SomeProperty=True)  # -> Values, Indices
values_33 = ValueListener(Elements=button_8, SomeProperty=True)  # -> Values, Indices
values_34 = ValueListener(Elements=slider_6, SomeProperty=True)  # -> Values, Indices
python_7 = GhPythonScript(x=values_32.Values, y="load mesh")  # -> a; same code as python
setbtn_4 = SetButton(ButtonToModify=pickbtn_4, ButtonName=python_7)
merge_24 = Merge(Data1=label_11, Data2=pickbtn_4, Data3=button_8, Data4=slider_6)  # -> graft(Result)
simplegrid_15 = CreateSimpleGrid(UIElements=merge_24, RowDefinitions="Auto", ColumnDefinitions=panel_8)  # -> flatten(SimpleGrid)

separator_3 = CreateSeparator(Thickness=0.5, Horizontal=True, Color=ColourSwatch(SwatchColor=RGB(217, 217, 217)))
merge_25 = Merge(Data1=simplegrid_12, Data2=simplegrid_14, Data3=simplegrid_13, Data4=separator_3, Data5=simplegrid_15)
merge_26 = Merge(Data1=merge_25, Data2=merge_18)

checkpoints = Point(values_4.Values)

# ---- group: heat diffusion layer
mesh = Mesh(values_31.Values)

# ---- group: painting layer
mesh_2 = Mesh(values_32.Values)

# ---- group: simulate surface
mesh_3 = Mesh(values_23.Values)

# ---- group: simulate surface mesh tri/quad
triangularmesh_feature_length = Slider(1, range=1..10)
quadmesh_points = Slider(10000, range=2000..10000)
triremesh = TriRemesh(Geometry=mesh_3, Length=triangularmesh_feature_length, Iterations=25)  # -> Triangulation, Dual, Creases
qrmesh = QuadRemesh(Mesh=mesh_3, Settings=quadmesh_points)
tri = Triangulate(Mesh=qrmesh)  # -> Mesh, Count
c_script_2 = CSharpScript(x=python_4.a, y=tri.Mesh, z=triremesh.Triangulation)  # -> A; inputs x: Boolean, y: tree, z: tree
# ---------- c_script_2: C# ----------
    if(x) A = y;
    else A = z;
# ---------- end c_script_2 ----------

# ----
mesh_4 = Mesh(c_script_2)

pt = Point(checkpoints)
demesh = DeconstructMesh(Mesh=mesh_4)  # -> Vertices, Faces, Colours, Normals
cp = ClosestPoint(Point=pt, Cloud=demesh.Vertices)  # -> ClosestPoint, CPIndex, Distance

# ---- group: heat diffusion layer & painting layer
c_script_3 = CSharpScript(x=mesh_2)  # -> A; inputs x: Mesh
# ---------- c_script_3: C# ----------
    A = x.GetNakedEdges();
# ---------- end c_script_3 ----------
c_script_4 = CSharpScript(x=mesh)  # -> A; inputs x: Mesh; same code as c_script_3
split_mesh_with_curve_on_mesh = SplitMeshWithCurveOnMesh(mesh=mesh_4, curve_on_mesh=c_script_3, cutting_thickness=2.5)
split_mesh_with_curve_on_mesh_2 = SplitMeshWithCurveOnMesh(mesh=mesh_4, curve_on_mesh=c_script_4, cutting_thickness=2.5)
item_3 = ListItem(List=split_mesh_with_curve_on_mesh_2, SelectIndex=values_30.Values, Wrap=True)
item_4 = ListItem(List=split_mesh_with_curve_on_mesh, SelectIndex=values_34.Values, Wrap=True)

# ----
panel_9 = Panel(values_8.Values)
panel_10 = Panel(values_7.Values)
panel_11 = Panel(values_9.Values)
panel_12 = Panel(values_6.Values)
c_script_5 = CSharpScript(x=values_5.Values, y=cp.ClosestPoint)  # -> A; inputs x: Boolean, y: list of Point3d
# ---------- c_script_5: C# ----------
    if(x) A = y;
    else return;
# ---------- end c_script_5 ----------
c_script_6 = CSharpScript(x=values_33.Values, y=item_4)  # -> A; inputs x: Boolean, y: Mesh; same code as c_script_5
c_script_7 = CSharpScript(x=values_24.Values, y=c_script_2)  # -> A; inputs x: Boolean, y: Mesh; same code as c_script_5
c_script_8 = CSharpScript(x=values_29.Values, y=item_3)  # -> A; inputs x: Boolean, y: Mesh; same code as c_script_5
demesh_2 = DeconstructMesh(Mesh=c_script_2)  # -> Vertices, Faces, Colours, Normals
demesh_3 = DeconstructMesh(Mesh=item_3)  # -> Vertices, Faces, Colours, Normals
demesh_4 = DeconstructMesh(Mesh=item_4)  # -> Vertices, Faces, Colours, Normals
merge_27 = Merge(Data1=c_script_7, Data2=c_script_8, Data3=c_script_6)
preview = CustomPreview(Geometry=merge_27, Material=ColourSwatch(SwatchColor=RGBA(255, 99, 123, 145)))
python_8 = GhPythonScript(x=demesh_3.Vertices)  # -> a; inputs x: list
# ---------- python_8: Python ----------
__author__ = "busin"
__version__ = "2023.02.04"

import rhinoscriptsyntax as rs
if x:
    a = True
else:
    a = False
# ---------- end python_8 ----------
and = GateAnd(A=python_8, B=values_10.Values)
path = FilePath(panel)

# ---- group: add pipe
inner_diameter_mm = Slider(3, range=0..5)
outer_diameter_mm = Slider(5, range=0..5)
start_trim_length_mm = Slider(0.5, range=0..3)
nozzle_length_mm = Slider(5, range=0..10)
panel_13 = Panel("pick solid mesh for exit pipes")
button_9 = CreateButton(ButtonName="update merged model", ButtonStyle=0)
toggle_4 = CreateToggle(Default=False, OnLabel="preview merged model", OffLabel="preview pipe")
pickbtn_5 = CreateRhinoPickButton(
    ButtonName="pick control points",
    Prompt="Please select geometry...",
    AllowMultiple=True,
    AllowNone=True,
    Type=4,
    ButtonStyle=0)
label_12 = CreateLabel(LabelText="Exit pipe1", LabelSize=12, Justification=0)
pickbtn_6 = CreateRhinoPickButton(
    ButtonName="pick control points",
    Prompt="Please select geometry...",
    AllowMultiple=True,
    AllowNone=True,
    Type=4,
    ButtonStyle=0)
label_13 = CreateLabel(LabelText="Exit pipe2", LabelSize=12, Justification=0)
pickbtn_7 = CreateRhinoPickButton(ButtonName=panel_13, Prompt="Please select geometry...", AllowMultiple=False, AllowNone=True, Type=3, ButtonStyle=0)
label_14 = CreateLabel(LabelText="Step3: Generate exit pipes", LabelSize=18, Justification=0)
slider_7 = CreateSlider(
    Slider=[start_trim_length_mm, nozzle_length_mm, inner_diameter_mm, outer_diameter_mm],
    ShowBounds=False,
    ShowTicks=False,
    ShowTooltip=False,
    ShowValLabel=True,
    showLabel=True)
values_35 = ValueListener(Elements=toggle_4, SomeProperty=True)  # -> Values, Indices
merge_28 = Merge(Data1=label_12, Data2=label_13)  # -> graft(Result)
merge_29 = Merge(Data1=pickbtn_6, Data2=pickbtn_5)  # -> graft(Result)
separator_4 = CreateSeparator(Thickness=0.5, Horizontal=True, Color=RGB(0, 0, 0))
values_36 = ValueListener(Elements=pickbtn_5, SomeProperty=True)  # -> Values, Indices
values_37 = ValueListener(Elements=pickbtn_7, SomeProperty=True)  # -> Values, Indices
values_38 = ValueListener(Elements=pickbtn_6, SomeProperty=True)  # -> Values, Indices
values_39 = ValueListener(Elements=button_9, SomeProperty=True)  # -> Values, Indices
values_40 = ValueListener(Elements=slider_7, SomeProperty=True)  # -> Values, Indices
mesh_5 = Mesh(values_37.Values)
mesh_6 = Mesh(mesh_5)
pt_2 = Point(flatten(values_38.Values))
pt_3 = Point(flatten(values_36.Values))
python_9 = GhPythonScript(y=panel_13, x=mesh_5)  # -> a
# ---------- python_9: Python ----------
__author__ = "LENOVO"
__version__ = "2022.09.06"

import rhinoscriptsyntax as rs
if x:
    a = y + " (√)"
else:
    a = y + " (null)"
# ---------- end python_9 ----------
merge_30 = Merge(Data1=toggle_4, Data2=button_9)  # -> graft(Result)
merge_31 = Merge(Data1=merge_28, Data2=merge_29)
bang = ExplodeTree(Data=values_40.Values)  # -> Branch0, Branch1, Branch2, Branch3
setbtn_5 = SetButton(ButtonToModify=pickbtn_7, ButtonName=python_9)
python_10 = GhPythonScript(y="pick control points", x=pt_3)  # -> a; same code as python_9
python_11 = GhPythonScript(y="pick control points", x=pt_2)  # -> a; same code as python_9
simplegrid_16 = CreateSimpleGrid(UIElements=merge_30, RowDefinitions="Auto", ColumnDefinitions="Auto")  # -> flatten(SimpleGrid)
simplegrid_17 = CreateSimpleGrid(UIElements=merge_31, RowDefinitions="Auto", ColumnDefinitions="1*")  # -> flatten(SimpleGrid)
setbtn_6 = SetButton(ButtonToModify=pickbtn_5, ButtonName=python_10)
setbtn_7 = SetButton(ButtonToModify=pickbtn_6, ButtonName=python_11)
cluster = Cluster_2(relay=pt_2, relay_2=mesh_5, l0=bang.Branch0, relay_3=bang.Branch1)  # -> C, C_2
cluster_2 = Cluster_2(relay=pt_3, relay_2=mesh_5, l0=bang.Branch0, relay_3=bang.Branch1)  # -> C, C_2
division = Division(A=bang.Branch2, B=2)
division_2 = Division(A=bang.Branch3, B=2)
merge_32 = Merge(Data1=simplegrid_17, Data2=slider_7)
merge_33 = Merge(Data1=cluster.C_2, Data2=cluster_2.C_2)
merge_34 = Merge(Data1=cluster.C, Data2=cluster_2.C)
merge_35 = Merge(Data1=separator_4, Data2=label_14, Data3=pickbtn_7, Data4=simplegrid_17, Data5=slider_7, Data6=simplegrid_16)
mpipe = MeshPipe(Curve=merge_33, Radius=division_2, Accuracy=0.2, Rotation=0, Segments=10, Caps=1)
mpipe_2 = MeshPipe(Curve=merge_34, Radius=division, Accuracy=0.2, Rotation=0, Segments=10, Caps=1)
mesh_7 = Mesh(mpipe_2)
mesh_8 = Mesh(mesh_7)
mesh_9 = Mesh(mpipe)
mesh_10 = Mesh(mesh_9)
merge_36 = Merge(Data1=mesh_6, Data2=mesh_10)  # -> flatten(Result)
merge_37 = Merge(Data1=mesh_7, Data2=mesh_9)

# ----
separator_5 = CreateSeparator(Thickness=0.5, Horizontal=True, Color=RGB(0, 0, 0))
toggle_5 = CreateToggle(Default=False, OnLabel="simulate", OffLabel="simulate")
label_15 = CreateLabel(LabelText="Step4: Simulate and export", LabelSize=18, Justification=0)
button_10 = CreateButton(ButtonName="export 3D printing model", ButtonStyle=0)
values_41 = ValueListener(Elements=button_10, SomeProperty=True)  # -> Values, Indices
values_42 = ValueListener(Elements=toggle_5, SomeProperty=True)  # -> Values, Indices
merge_38 = Merge(Data1=toggle_5, Data2=button_10)  # -> graft(Result)
panel_14 = Panel("""1*
2*""")
simplegrid_18 = CreateSimpleGrid(UIElements=merge_38, RowDefinitions="Auto", ColumnDefinitions=panel_14)
merge_39 = Merge(Data1=separator_5, Data2=label_15, Data3=simplegrid_18)

# ---- group: simulation switch
bool = Boolean(values_42.Values)

# ----
onoff = EnableDisableObject(Enabled=bool, AllObjects_Object=[data_3, mesh_3, mesh_2, mesh])
bool_2 = Boolean(bool)

launchwin_2 = LaunchWindow(
    Show=bool_2,
    Name="simulation",
    Width=Slider(610, range=0..1000),
    Height=Slider(700, range=0..1000),
    ChildStatus=2,
    EnableHorizScroll=False)

grow_step_length_mm = Slider(1, range=0..3)
end_extend_length_mm = Slider(3, range=0..50)
grow_length_mm = Slider(10, range=0..50)
start_trim_length_mm_2 = Slider(3, range=0..50)
interval_mm = Slider(3.5, range=0..10)
panel_15 = Panel("pick surface mesh for sketching")
pickbtn_8 = CreateRhinoPickButton(
    ButtonName="pick guide line",
    Prompt="Please select geometry...",
    AllowMultiple=False,
    AllowNone=True,
    Type=2,
    ButtonStyle=0)
pickbtn_9 = CreateRhinoPickButton(ButtonName=panel_15, Prompt="Please select geometry...", AllowMultiple=False, AllowNone=True, Type=3, ButtonStyle=0)
toggle_6 = CreateToggle(Default=Toggle(True), OnLabel="flip guide line", OffLabel="flip guide line")
slider_8 = CreateSlider(
    Slider=[interval_mm, grow_length_mm, grow_step_length_mm, start_trim_length_mm_2, end_extend_length_mm],
    ShowBounds=False,
    ShowTicks=False,
    ShowTooltip=False,
    ShowValLabel=True,
    showLabel=True)
values_43 = ValueListener(Elements=pickbtn_8, SomeProperty=True)  # -> Values, Indices
values_44 = ValueListener(Elements=pickbtn_9, SomeProperty=True)  # -> Values, Indices
values_45 = ValueListener(Elements=slider_8, SomeProperty=True)  # -> Values, Indices
values_46 = ValueListener(Elements=toggle_6, SomeProperty=True)  # -> Values, Indices
bang_2 = ExplodeTree(Data=values_45.Values)  # -> Branch0, Branch1, Branch2, Branch3, Branch4
mesh_11 = Mesh(values_44.Values)
crv = Curve(values_43.Values)
python_12 = GhPythonScript(y="pick guide line", x=crv)  # -> a; same code as python_9
python_13 = GhPythonScript(y=panel_15, x=mesh_11)  # -> a; same code as python_9
setbtn_8 = SetButton(ButtonToModify=pickbtn_8, ButtonName=python_12)
setbtn_9 = SetButton(ButtonToModify=pickbtn_9, ButtonName=python_13)
linear_lines = LinearLines(
    carve_surface_mesh=mesh_11,
    guideline=crv,
    flip=values_46.Values,
    interval=bang_2.Branch0,
    grow_length=bang_2.Branch1,
    resolution=bang_2.Branch2,
    start_trim_length=bang_2.Branch3,
    end_extend_length=bang_2.Branch4)  # -> loft_mesh, array_spline; disabled
merge_40 = Merge(Data1=pickbtn_9, Data2=pickbtn_8, Data3=slider_8, Data4=toggle_6)
mesh_12 = Mesh(linear_lines.loft_mesh)  # disabled
crv_2 = Curve(linear_lines.array_spline)  # disabled
entwine_2 = Entwine(Branch00=mesh_12, Branch01=crv_2, FlattenInputs=True)

start_trim_length_mm_3 = Slider(3, range=0..50)
end_trim_length_mm = Slider(3, range=0..50)
interval_mm_2 = Slider(3.5, range=0..10)
panel_16 = Panel("pick surface mesh for sketching")
pickbtn_10 = CreateRhinoPickButton(
    ButtonName="pick axial line",
    Prompt="Please select geometry...",
    AllowMultiple=False,
    AllowNone=True,
    Type=2,
    ButtonStyle=0)
pickbtn_11 = CreateRhinoPickButton(ButtonName=panel_16, Prompt="Please select geometry...", AllowMultiple=False, AllowNone=True, Type=3, ButtonStyle=0)
slider_9 = CreateSlider(Slider=interval_mm_2, ShowBounds=False, ShowTicks=False, ShowTooltip=False, ShowValLabel=True, showLabel=True)
slider_10 = CreateSlider(
    Slider=[start_trim_length_mm_3, end_trim_length_mm],
    ShowBounds=False,
    ShowTicks=False,
    ShowTooltip=False,
    ShowValLabel=True,
    showLabel=True)
values_47 = ValueListener(Elements=pickbtn_10, SomeProperty=True)  # -> Values, Indices
values_48 = ValueListener(Elements=pickbtn_11, SomeProperty=True)  # -> Values, Indices
values_49 = ValueListener(Elements=slider_10, SomeProperty=True)  # -> Values, Indices
values_50 = ValueListener(Elements=slider_9, SomeProperty=True)  # -> Values, Indices
bang_3 = ExplodeTree(Data=values_49.Values)  # -> Branch0, Branch1
mesh_13 = Mesh(values_48.Values)
crv_3 = Curve(values_47.Values)
python_14 = GhPythonScript(y="pick axial line", x=crv_3)  # -> a; same code as python_9
python_15 = GhPythonScript(y=panel_16, x=mesh_13)  # -> a; same code as python_9
setbtn_10 = SetButton(ButtonToModify=pickbtn_10, ButtonName=python_14)
setbtn_11 = SetButton(ButtonToModify=pickbtn_11, ButtonName=python_15)
helical_line = HelicalLine(data=mesh_13, relay=crv_3, L=values_50.Values)  # disabled
merge_41 = Merge(Data1=pickbtn_11, Data2=pickbtn_10, Data3=slider_9, Data4=slider_10)
ext = ExtendCurve(Curve=helical_line, Type=0, Start=expr("-x", bang_3.Branch0), End=expr("-x", bang_3.Branch1))
mesh_14 = Mesh(mesh_13)  # disabled
crv_4 = Curve(ext)  # disabled
entwine_3 = Entwine(Branch00=mesh_14, Branch01=crv_4, FlattenInputs=True)

interval_mm_3 = Slider(3.5, range=0..10)
end_trim_length_mm_2 = Slider(3, range=0..50)
start_trim_length_mm_4 = Slider(3, range=0..50)
count = Slider(3, range=0..10)
panel_17 = Panel("pick surface mesh for sketching")
pickbtn_12 = CreateRhinoPickButton(
    ButtonName="pick boundary line",
    Prompt="Please select geometry...",
    AllowMultiple=False,
    AllowNone=True,
    Type=2,
    ButtonStyle=0)
pickbtn_13 = CreateRhinoPickButton(ButtonName=panel_17, Prompt="Please select geometry...", AllowMultiple=False, AllowNone=True, Type=3, ButtonStyle=0)
toggle_7 = CreateToggle(Default=Toggle(True), OnLabel="flip boundary line", OffLabel="flip boundary line")
slider_11 = CreateSlider(Slider=[interval_mm_3, count], ShowBounds=False, ShowTicks=False, ShowTooltip=False, ShowValLabel=True, showLabel=True)
slider_12 = CreateSlider(
    Slider=[start_trim_length_mm_4, end_trim_length_mm_2],
    ShowBounds=False,
    ShowTicks=False,
    ShowTooltip=False,
    ShowValLabel=True,
    showLabel=True)
values_51 = ValueListener(Elements=toggle_7, SomeProperty=True)  # -> Values, Indices
values_52 = ValueListener(Elements=slider_12, SomeProperty=True)  # -> Values, Indices
values_53 = ValueListener(Elements=slider_11, SomeProperty=True)  # -> Values, Indices
values_54 = ValueListener(Elements=pickbtn_12, SomeProperty=True)  # -> Values, Indices
values_55 = ValueListener(Elements=pickbtn_13, SomeProperty=True)  # -> Values, Indices
bang_4 = ExplodeTree(Data=values_53.Values)  # -> Branch0, Branch1
bang_5 = ExplodeTree(Data=values_52.Values)  # -> Branch0, Branch1
mesh_15 = Mesh(values_55.Values)
crv_5 = Curve(values_54.Values)
python_16 = GhPythonScript(y="pick boundary line", x=crv_5)  # -> a; same code as python_9
python_17 = GhPythonScript(y=panel_17, x=mesh_15)  # -> a; same code as python_9
setbtn_12 = SetButton(ButtonToModify=pickbtn_12, ButtonName=python_16)
setbtn_13 = SetButton(ButtonToModify=pickbtn_13, ButtonName=python_17)
spiral_line = SpiralLine(
    carve_surface_mesh=mesh_15,
    guideline=crv_5,
    flip_guideline=values_51.Values,
    interval=bang_4.Branch0,
    iteration_times=bang_4.Branch1)  # disabled
merge_42 = Merge(Data1=pickbtn_13, Data2=pickbtn_12, Data3=slider_11, Data4=slider_12, Data5=toggle_7)
ext_2 = ExtendCurve(Curve=spiral_line, Type=0, Start=expr("-x", bang_5.Branch0), End=expr("-x", bang_5.Branch1))
mesh_16 = Mesh(mesh_15)  # disabled
crv_6 = Curve(ext_2)  # disabled
entwine_4 = Entwine(Branch00=mesh_16, Branch01=crv_6, FlattenInputs=True)

panel_18 = Panel("pick customized channel lines")
pickbtn_14 = CreateRhinoPickButton(ButtonName=panel_18, Prompt="Please select geometry...", AllowMultiple=True, AllowNone=True, Type=2, ButtonStyle=0)
values_56 = ValueListener(Elements=pickbtn_14, SomeProperty=True)  # -> Values, Indices
crv_7 = Curve(values_56.Values)
python_18 = GhPythonScript(y=panel_18, x=crv_7)  # -> a; same code as python_9
setbtn_14 = SetButton(ButtonToModify=pickbtn_14, ButtonName=python_18)
crv_8 = Curve(crv_7)
entwine_5 = Entwine(Branch01=crv_8, FlattenInputs=True)

panel_19 = Panel("""select...
Linear lines
Spiral line
Helical line
Customized lines""")
label_16 = CreateLabel(LabelText="Step1: Generate channel lines", LabelSize=18, Justification=0)
pulldown_3 = CreatePulldownMenu(Label="Select primitive", ListItems=panel_19, SelectedIndex=Slider(0, range=0..100), showLabel=True)
values_57 = ValueListener(Elements=pulldown_3, SomeProperty=True)  # -> Values, Indices
python_19 = GhPythonScript(x=values_57.Values, y=panel_19)  # -> out, index, bools; inputs y: list
# ---------- python_19: Python ----------
__author__ = "LENOVO"
__version__ = "2022.09.06"

import rhinoscriptsyntax as rs
l = len(y)
bools = []
for i in range(l):
    bools.append(False)
    if x == y[i]:
        index = i

bools[index] = True
# ---------- end python_19 ----------
item_5 = ListItem(List=python_19.bools, Index=0, Wrap=True)  # -> Item, Item1, Item2, Item3, Item4
separator_6 = CreateSeparator(Thickness=0.5, Horizontal=True, Color=RGB(0, 0, 0))
merge_43 = Merge(Data1=merge_40, Data2=merge_42, Data3=merge_41, Data4=pickbtn_14)
merge_44 = Merge(Data1=entwine_2, Data2=entwine_4, Data3=entwine_3, Data4=entwine_5)
bang_6 = ExplodeTree(Data=merge_44)  # -> Branch0, Branch1
merge_45 = Merge(Data1=label_16, Data2=pulldown_3, Data3=merge_43, Data4=separator_6)  # -> flatten(Result)

# ---- group: channel structure / auto carve mesh
mesh_17 = Mesh(bang_6.Branch0)

# ---- group: channel structure / channel lines
crv_9 = Curve(bang_6.Branch1)

# ----
hideshow = HideShowElement(ElementToHideShow=pickbtn_14, Show=item_5.Item4, Collapse=True, Disable=False)
onoff_2 = EnableDisableObject(Enabled=item_5.Item4, AllObjects_Object=crv_8)

onoff_3 = EnableDisableObject(Enabled=item_5.Item1, AllObjects_Object=[crv_2, linear_lines, mesh_12])
hideshow_2 = HideShowElement(ElementToHideShow=merge_40, Show=item_5.Item1, Collapse=True, Disable=False)

onoff_4 = EnableDisableObject(Enabled=item_5.Item2, AllObjects_Object=[spiral_line, crv_6, mesh_16])
hideshow_3 = HideShowElement(ElementToHideShow=merge_42, Show=item_5.Item2, Collapse=True, Disable=False)

hideshow_4 = HideShowElement(ElementToHideShow=merge_41, Show=item_5.Item3, Collapse=True, Disable=False)
onoff_5 = EnableDisableObject(Enabled=item_5.Item3, AllObjects_Object=[helical_line, crv_4, mesh_14])

# ---- group: channel structure
panel_20 = Panel("pick solid mesh for carving")
pickbtn_15 = CreateRhinoPickButton(ButtonName=panel_20, Prompt="Please select geometry...", AllowMultiple=False, AllowNone=True, Type=3, ButtonStyle=0)
textbox_15 = CreateTextBox(
    Label=["wall width(mm)", "channel depth(mm)", "carve step length(mm)"],
    DefaultText=[Slider(0.5, range=0..1), Slider(3, range=0..10), Slider(1, range=0..10)],
    UpdateButton=False,
    showLabel=True)
values_58 = ValueListener(Elements=pickbtn_15, SomeProperty=True)  # -> Values, Indices
values_59 = ValueListener(Elements=textbox_15, SomeProperty=True)  # -> Values, Indices
bang_7 = ExplodeTree(Data=values_59.Values)  # -> Branch0, Branch1, Branch2
mesh_18 = Mesh(values_58.Values)
python_20 = GhPythonScript(y=panel_20, x=mesh_18)  # -> a; same code as python_9
setbtn_15 = SetButton(ButtonToModify=pickbtn_15, ButtonName=python_20)
entwine_6 = Entwine(
    Branch00=mesh_18,
    Branch01=crv_9,
    Branch02=bang_7.Branch0,
    Branch03=bang_7.Branch1,
    Branch04=bang_7.Branch2,
    FlattenInputs=True)
merge_46 = Merge(Data1=pickbtn_15, Data2=textbox_15)
bang_8 = ExplodeTree(Data=entwine_6)  # -> Branch0, Branch1, Branch2, Branch3, Branch4

panel_21 = Panel("pick solid mesh for carving")
pickbtn_16 = CreateRhinoPickButton(ButtonName=panel_21, Prompt="Please select geometry...", AllowMultiple=False, AllowNone=True, Type=3, ButtonStyle=0)
label_17 = CreateLabel(LabelText="channel depth(mm)", LabelSize=12, Justification=0)
textbox_16 = CreateTextBox(Label="channel diameter(mm)", DefaultText=Slider(5, range=0..10), UpdateButton=False, showLabel=True)
values_60 = ValueListener(Elements=pickbtn_16, SomeProperty=True)  # -> Values, Indices
values_61 = ValueListener(Elements=textbox_16, SomeProperty=True)  # -> Values, Indices
python_21 = GhPythonScript(x="channel depth(mm)", y=values_61.Values)  # -> a
# ---------- python_21: Python ----------
__author__ = "busin"
__version__ = "2023.01.26"

import rhinoscriptsyntax as rs
a = x + " = " + str(y/2)
# ---------- end python_21 ----------
bang_9 = ExplodeTree(Data=values_61.Values)
mesh_19 = Mesh(values_60.Values)
python_22 = GhPythonScript(y=panel_21, x=mesh_19)  # -> a; same code as python_9
setlabel = SetLabelContents(LabelToModify=label_17, NewLabelContents=python_21)
setbtn_16 = SetButton(ButtonToModify=pickbtn_16, ButtonName=python_22)
entwine_7 = Entwine(Branch00=mesh_19, Branch01=crv_9, Branch02=bang_9, FlattenInputs=True)
merge_47 = Merge(Data1=pickbtn_16, Data2=textbox_16, Data3=label_17)
bang_10 = ExplodeTree(Data=entwine_7)  # -> Branch0, Branch1, Branch2

label_18 = CreateLabel(LabelText="(invalid)", LabelSize=12, Justification=0)
toggle_8 = CreateToggle(Default=False, OnLabel="surface mesh for carving: auto", OffLabel="surface mesh for carving: picked")
pickbtn_17 = CreateRhinoPickButton(ButtonName="pick mesh", Prompt="Please select geometry...", AllowMultiple=False, AllowNone=True, Type=3, ButtonStyle=0)
textbox_17 = CreateTextBox(
    Label=["wall width(mm)", "channel depth(mm)"],
    DefaultText=[Slider(0.5, range=0..1), Slider(3, range=0..10)],
    UpdateButton=False,
    showLabel=True)
values_62 = ValueListener(Elements=toggle_8, SomeProperty=True)  # -> Values, Indices
python_23 = GhPythonScript(autoswitch=values_62.Values, automesh=mesh_17)  # -> a; inputs automesh: Mesh
# ---------- python_23: Python ----------
__author__ = "LENOVO"
__version__ = "2022.09.06"

import rhinoscriptsyntax as rs
a = False
if autoswitch:
    if not automesh:
        a=True
# ---------- end python_23 ----------
values_63 = ValueListener(Elements=pickbtn_17, SomeProperty=True)  # -> Values, Indices
values_64 = ValueListener(Elements=textbox_17, SomeProperty=True)  # -> Values, Indices
mesh_20 = Mesh(values_63.Values)
hideshow_5 = HideShowElement(ElementToHideShow=pickbtn_17, Show=invert(values_62.Values), Collapse=True, Disable=False)
hideshow_6 = HideShowElement(ElementToHideShow=label_18, Show=python_23, Collapse=True, Disable=False)
bang_11 = ExplodeTree(Data=values_64.Values)  # -> Branch0, Branch1
filter = StreamFilter(Gate=values_62.Values, Stream0=mesh_20, Stream1=mesh_17)
python_24 = GhPythonScript(y="pick mesh", x=mesh_20)  # -> a; same code as python_9
merge_48 = Merge(Data1=flatten(toggle_8), Data2=flatten(pickbtn_17), Data3=flatten(label_18))  # -> graft(Result)
setbtn_17 = SetButton(ButtonToModify=pickbtn_17, ButtonName=python_24)
entwine_8 = Entwine(Branch00=filter, Branch01=crv_9, Branch02=bang_11.Branch0, Branch03=bang_11.Branch1, FlattenInputs=True)
simplegrid_19 = CreateSimpleGrid(UIElements=merge_48, RowDefinitions="Auto", ColumnDefinitions="Auto")  # -> flatten(SimpleGrid)
bang_12 = ExplodeTree(Data=entwine_8)  # -> Branch0, Branch1, Branch2, Branch3
merge_49 = Merge(Data1=simplegrid_19, Data2=textbox_17)

panel_22 = Panel("""select...
Difference Method
Intersection Method (fixed diameter)
Intersection Method (dynamic diameter)""")
label_19 = CreateLabel(LabelText="Step2: Generate channel structures", LabelSize=18, Justification=0)
pulldown_4 = CreatePulldownMenu(Label="Select method", ListItems=panel_22, SelectedIndex=Slider(0, range=0..100), showLabel=True)
values_65 = ValueListener(Elements=pulldown_4, SomeProperty=True)  # -> Values, Indices
button_11 = CreateButton(ButtonName="generate", ButtonStyle=0)
python_25 = GhPythonScript(x=values_65.Values, y=panel_22)  # -> out, index, bools; inputs y: list; same code as python_19
values_66 = ValueListener(Elements=button_11, SomeProperty=True)  # -> Values, Indices
item_6 = ListItem(List=python_25.bools, Index=0, Wrap=True)  # -> Item, Item1, Item2, Item3
hideshow_7 = HideShowElement(ElementToHideShow=button_11, Show=invert(item_6.Item), Collapse=True, Disable=False)

cluster_3 = IntersectionMethodFixedDiameter(carve_solid_mesh=bang_10.Branch0, guideline=bang_10.Branch1, channel_diameter=bang_10.Branch2, switch=values_66.Values)  # -> channel_mesh, R
mesh_21 = Mesh(cluster_3.channel_mesh)
c_script_9 = CSharpScript(x=mesh_21, y=values_66.Values)  # -> out, A; inputs x: Mesh, y: Boolean
# ---------- c_script_9: C# ----------
    A = a;
    if(y){
      a = x;
    }
# ---------- c_script_9: C# additional code ----------
  Mesh a;
# ---------- end c_script_9 ----------
c_script_10 = CSharpScript(x=cluster_3.R, y=values_66.Values)  # -> out, A; inputs x: tree, y: Boolean
# ---------- c_script_10: C# ----------
    A = a;
    if(y){
      a = x;
    }
# ---------- c_script_10: C# additional code ----------
  DataTree<System.Object> a;
# ---------- end c_script_10 ----------
onoff_6 = EnableDisableObject(Enabled=item_6.Item2, AllObjects_Object=cluster_3)
hideshow_8 = HideShowElement(ElementToHideShow=merge_47, Show=item_6.Item2, Collapse=True, Disable=False)

difference_method = DifferenceMethod(
    carve_surface_mesh=bang_12.Branch0,
    guidelines=bang_12.Branch1,
    wall_width=bang_12.Branch2,
    channel_depth=bang_12.Branch3,
    switch=values_66.Values)  # -> channel_mesh, R; disabled
mesh_22 = Mesh(difference_method.channel_mesh)
c_script_11 = CSharpScript(x=mesh_22, y=values_66.Values)  # -> out, A; inputs x: Mesh, y: Boolean; same code as c_script_9
c_script_12 = CSharpScript(x=difference_method.R, y=values_66.Values)  # -> out, A; inputs x: tree, y: Boolean; same code as c_script_10
onoff_7 = EnableDisableObject(Enabled=item_6.Item1, AllObjects_Object=difference_method)
hideshow_9 = HideShowElement(ElementToHideShow=merge_49, Show=item_6.Item1, Collapse=True, Disable=False)

intersection_method_dynamic_diameter = IntersectionMethodDynamicDiameter(
    carve_solid_mesh=bang_8.Branch0,
    guidelines=bang_8.Branch1,
    wall_width=bang_8.Branch2,
    channel_depth=bang_8.Branch3,
    carve_step_length=bang_8.Branch4,
    switch=values_66.Values)  # -> channel_mesh, channel_data; disabled
mesh_23 = Mesh(intersection_method_dynamic_diameter.channel_mesh)
c_script_13 = CSharpScript(x=mesh_23, y=values_66.Values)  # -> out, A; inputs x: Mesh, y: Boolean; same code as c_script_9
c_script_14 = CSharpScript(x=intersection_method_dynamic_diameter.channel_data, y=values_66.Values)  # -> out, A; inputs x: tree, y: Boolean; same code as c_script_10
onoff_8 = EnableDisableObject(Enabled=item_6.Item3, AllObjects_Object=intersection_method_dynamic_diameter)
hideshow_10 = HideShowElement(ElementToHideShow=merge_46, Show=item_6.Item3, Collapse=True, Disable=False)

merge_50 = Merge(Data1=c_script_12.A, Data2=c_script_10.A, Data3=c_script_14.A)
merge_51 = Merge(Data1=flatten(c_script_11.A), Data2=flatten(c_script_9.A), Data3=flatten(c_script_13.A))
subtraction = Subtraction(A=python_25.index, B=1)
merge_52 = Merge(Data1=merge_49, Data2=merge_46, Data3=merge_47)
item_7 = ListItem(List=merge_51, Index=subtraction, Wrap=False)

merge_53 = Merge(Data1=label_19, Data2=pulldown_4, Data3=merge_52, Data4=button_11)

# ---- group: channel structure / channel mesh
mesh_24 = Mesh(item_7)

# ---- group: add pipe (continued)
mesh_25 = Mesh(mesh_24)
merge_54 = Merge(Data1=mesh_25, Data2=mesh_8)  # -> flatten(Result)
entwine_9 = Entwine(Branch00=merge_54, Branch01=merge_36, FlattenInputs=True)
gate = StreamGate(Stream=entwine_9, Gate=values_39.Values)  # -> Target0, Target1
bang_13 = ExplodeTree(Data=gate.Target1)  # -> Branch0, Branch1
munion = MeshUnion(Meshes=bang_13.Branch1)
munion_2 = MeshUnion(Meshes=bang_13.Branch0)
flipm = FlipMesh(Mesh=munion_2, VertexNormals=True, FaceNormals=True, FaceOrientation=True)
mjoin = MeshJoin(Meshes=flatten([flipm, munion]))
c_script_15 = CSharpScript(x=munion_2, y=values_39.Values)  # -> out, A; inputs x: Mesh, y: Boolean; same code as c_script_9
c_script_16 = CSharpScript(x=munion, y=values_39.Values)  # -> out, A; inputs x: Mesh, y: Boolean; same code as c_script_9
c_script_17 = CSharpScript(x=mjoin, y=values_39.Values)  # -> out, A; inputs x: Mesh, y: Boolean; same code as c_script_9
mesh_26 = Mesh(c_script_17.A)

# ----
mesh_27 = Mesh(mesh_26)
bake = BakeGeometry(Bake=values_41.Values, Geometry=mesh_27, DeleteOldBakes=False, PreserveTrees=False)

# ---- group: channel structure / channel data {mesh, width[], section area[]}
data = Data(merge_50)

# ---- group: channel data
data_2 = Data(data)

# ---- group: display
filter_2 = StreamFilter(Gate=values_42.Values, Stream0=values_35.Values)
number_slider = Slider(0.7, range=0..1)
gate_2 = StreamGate(Stream=merge_37, Gate=filter_2)  # -> Target0, Target1
gate_3 = StreamGate(Stream=c_script_15.A, Gate=filter_2)  # -> Target0, Target1
gate_4 = StreamGate(Stream=c_script_16.A, Gate=filter_2)  # -> Target0, Target1
gate_5 = StreamGate(Stream=merge_34, Gate=filter_2)  # -> Target0, Target1
number_slider_2 = Slider(2.2, range=0..11)
swatch = ColourSwatch(SwatchColor=RGB(255, 128, 0))
swatch_2 = ColourSwatch(SwatchColor=RGB(255, 209, 232))
gate_6 = StreamGate(Stream=item_7, Gate=filter_2)  # -> Target0, Target1
gate_7 = StreamGate(Stream=crv_9, Gate=filter_2)  # -> Target0, Target1
previewmat = CustomPreviewMaterials(Geometry=gate_6.Target0, DiffuseColor=swatch_2, Transparency=number_slider)
previewmat_2 = CustomPreviewMaterials(Geometry=gate_2.Target0, DiffuseColor=swatch_2, Transparency=number_slider)
previewmat_3 = CustomPreviewMaterials(Geometry=gate_3.Target1, DiffuseColor=swatch_2, Transparency=number_slider)
previewlw = CustomPreviewLineweights(Geometry=gate_7.Target0, Shader=swatch, Thickness=number_slider_2, Absolute=False)
previewlw_2 = CustomPreviewLineweights(Geometry=gate_5.Target0, Shader=swatch, Thickness=number_slider_2, Absolute=False)
previewmat_4 = CustomPreviewMaterials(Geometry=gate_4.Target1, DiffuseColor=ColourSwatch(SwatchColor=RGB(255, 255, 255)), Transparency=Slider(0.8, range=0..1))

# ----
merge_55 = Merge(Data1=merge_45, Data2=merge_53, Data3=merge_35, Data4=merge_39)
addelems = AddElements(Window=launchwin, Elements=flatten(merge_55), DoVLChecking=True)  # -> AddedElements, ElementNames

# ---- group: fluid channel data
c_script_18 = CSharpScript(x=data_2, y=values_26.Values)  # -> A; inputs x: tree, y: Boolean; same code as c_script_10
data_3 = Data(c_script_18)

# ----
flow_rate_ml_min = Slider(150, range=0..300)
temperature_c = Slider(50, range=0..100)
panel_23 = Panel(panel)
label_20 = CreateLabel(LabelText="Simulation control panel", LabelSize=18, Justification=0)
slider_13 = CreateSlider(Slider=flow_rate_ml_min, ShowBounds=False, ShowTicks=False, ShowTooltip=False, ShowValLabel=True, showLabel=True)
toggle_9 = CreateToggle(Default=True, OnLabel="water/atr: water", OffLabel="water/atr: air")
toggle_10 = CreateToggle(Default=True, OnLabel="direction: forward", OffLabel="direction: backward")
slider_14 = CreateSlider(Slider=temperature_c, ShowBounds=False, ShowTicks=False, ShowTooltip=False, ShowValLabel=True, showLabel=True)
toggle_11 = CreateToggle(Default=False, OnLabel="set view: thermography", OffLabel="set view: photography")
values_67 = ValueListener(Elements=toggle_9, SomeProperty=True)  # -> Values, Indices
values_68 = ValueListener(Elements=toggle_11, SomeProperty=True)  # -> Values, Indices
values_69 = ValueListener(Elements=toggle_10, SomeProperty=True)  # -> Values, Indices
values_70 = ValueListener(Elements=slider_13, SomeProperty=True)  # -> Values, Indices
values_71 = ValueListener(Elements=slider_14, SomeProperty=True)  # -> Values, Indices
merge_56 = Merge(Data1=toggle_9, Data2=toggle_10)  # -> graft(Result)
panel_24 = Panel("""2*
3*""")
simplegrid_20 = CreateSimpleGrid(UIElements=merge_56, RowDefinitions="Auto", ColumnDefinitions=panel_24)  # -> flatten(SimpleGrid)
separator_7 = CreateSeparator(Thickness=0.5, Horizontal=True, Color=RGB(0, 0, 0))
separator_8 = CreateSeparator(Thickness=0.5, Horizontal=True, Color=RGB(0, 0, 0))

c_script_19 = CSharpScript(x=panel_23)  # -> A; inputs x: String
# ---------- c_script_19: C# ----------
    A = x + @"\icons";
# ---------- end c_script_19 ----------

c_script_20 = CSharpScript(x=c_script_19)  # -> A; inputs x: String
# ---------- c_script_20: C# ----------
    A = x + @"\play.png";
# ---------- end c_script_20 ----------
c_script_21 = CSharpScript(x=c_script_19)  # -> A; inputs x: String
# ---------- c_script_21: C# ----------
    A = x + @"\stop1.png";
# ---------- end c_script_21 ----------
c_script_22 = CSharpScript(x=c_script_19)  # -> A; inputs x: String
# ---------- c_script_22: C# ----------
    A = x + @"\pause.png";
# ---------- end c_script_22 ----------
button_12 = CreateButton(ImagePath=c_script_20, ButtonStyle=0)
button_13 = CreateButton(ImagePath=c_script_22, ButtonStyle=0)
button_14 = CreateButton(ImagePath=c_script_21, ButtonStyle=0)
values_72 = ValueListener(Elements=button_13, SomeProperty=True)  # -> Values, Indices
values_73 = ValueListener(Elements=button_12, SomeProperty=True)  # -> Values, Indices
values_74 = ValueListener(Elements=button_14, SomeProperty=True)  # -> Values, Indices
merge_57 = Merge(Data1=button_12, Data2=button_13, Data3=button_14)  # -> graft(Result)
simplegrid_21 = CreateSimpleGrid(UIElements=merge_57, RowDefinitions="Auto", ColumnDefinitions="1*")  # -> flatten(SimpleGrid)
merge_58 = Merge(Data1=simplegrid_21, Data2=toggle_11)  # -> graft(Result)
simplegrid_22 = CreateSimpleGrid(UIElements=merge_58, RowDefinitions="Auto", ColumnDefinitions=panel_24)  # -> flatten(SimpleGrid)
merge_59 = Merge(
    Data1=separator_8,
    Data2=label_20,
    Data3=simplegrid_22,
    Data4=simplegrid_20,
    Data5=slider_14,
    Data6=slider_13,
    Data7=separator_7)

# ---- group: flow direction
bool_3 = Boolean(values_69.Values)

# ----
not = GateNot(A=values_67.Values)
multiplication = Multiplication(A=values_70.Values, B=Slider(16.7, range=0..100))
ss = SimulatorSetter(
    SimulatorDirectory=panel,
    Temperature=values_71.Values,
    RateOfWaterFlow=multiplication,
    WaterDirection=values_69.Values,
    LoadingAir=not,
    Start=values_73.Values,
    Pauser=values_72.Values,
    Kill=values_74.Values)
c_script_23 = CSharpScript(x=ss, y=values_73.Values)  # -> A; inputs x: String, y: Boolean
# ---------- c_script_23: C# ----------
    if(y && x == null){
      A = x;
    }
    else{
      A = p;
    }
    p = x;
# ---------- c_script_23: C# additional code ----------
  string p;
# ---------- end c_script_23 ----------

# ---- group: fluid layer: points, widths, section areas
bang_14 = ExplodeTree(Data=data_3)  # -> Branch0, Branch1, Branch2
cp_2 = ControlPoints(Curve=bang_14.Branch0)  # -> Points, Weights, Knots
entwine_10 = Entwine(Branch00=cp_2.Points, Branch01=bang_14.Branch1, Branch02=bang_14.Branch2, FlattenInputs=True)
bang_15 = ExplodeTree(Data=entwine_10)  # -> flatten(Branch0), Branch1, Branch2
rev = ReverseList(List=bang_15.Branch0)
rev_2 = ReverseList(List=bang_15.Branch1)
rev_3 = ReverseList(List=bang_15.Branch2)
c_script_24 = CSharpScript(x=bool_3, y=bang_15.Branch0, z=rev)  # -> A; inputs x: Boolean; same code as c_script_2
c_script_25 = CSharpScript(x=bool_3, y=bang_15.Branch1, z=rev_2)  # -> A; inputs x: Boolean; same code as c_script_2
c_script_26 = CSharpScript(x=bool_3, y=bang_15.Branch2, z=rev_3)  # -> A; inputs x: Boolean; same code as c_script_2

# ----
c_script_27 = CSharpScript(x=values_27.Values, y=bang_14.Branch0)  # -> A; inputs x: Boolean, y: Polyline; same code as c_script_5
previewlw_3 = CustomPreviewLineweights(
    Geometry=[c_script_27, c_script_5],
    Shader=ColourSwatch(SwatchColor=RGB(255, 128, 0)),
    Thickness=Slider(2.2, range=0..11),
    Absolute=False)

sstr = SimulatorStarter(
    UseDecorate=and,
    CoefficientWaterToBase=panel_12,
    CoefficientBaseToDecorate=panel_9,
    CoefficientBaseToAir=panel_10,
    CoefficientDecorateToAir=panel_11,
    BaseLayerThickness=values_13.Values,
    DecorateLayerThickness=values_12.Values,
    EnvironmentTemperature=values_11.Values,
    WaterStartTemperature=values_71.Values,
    WaterStartFlow=multiplication,
    BaseMaterial=values_14.Values,
    DecorateMaterial=values_15.Values,
    MeshForSimulatonBaseLayerMesh=c_script_2,
    DecorateLayerMeshPoints=demesh_3.Vertices,
    PolylineWater=python_5.a,
    WaterPoints=c_script_24,
    WaterWidths=c_script_25,
    WaterSectionArea=c_script_26,
    GenerateStarterFileTrigger=values_16.Values,
    ClearTemporaryFilesTrigger=Button(),
    WorkingDirectory=panel,
    CheckPointIndex=cp.CPIndex)
txt = Text("Water format not satisfied")
python_26 = GhPythonScript(x=sstr, y=path, z=txt)  # -> a
# ---------- python_26: Python ----------
__author__ = "23776"
__version__ = "2023.02.03"

import rhinoscriptsyntax as rs

if x is None:
    a = "Mesh not set"
elif x is z:
    a = "Fluid not update"
elif x is not y:
    a = "Unset parameters"
else:
    a = None
# ---------- end python_26 ----------

# ---- group: debugging information
panel_25 = Panel(python_26)
panel_26 = Panel(c_script_23)

# ----
tabs = TabbedView(
    TabNames=["Simulation configuration", "Advance"],
    TabTextSize=Slider(20, range=0..100),
    Tab0=flatten(merge_26),
    Tab1=flatten(merge_12))
merge_60 = Merge(Data1=tabs, Data2=merge_13, Data3=merge_59, Data4=merge_2)
addelems_2 = AddElements(Window=launchwin_2, Elements=flatten(merge_60), DoVLChecking=True)  # -> AddedElements, ElementNames

# ---- group: display
not_2 = GateNot(A=values_2.Values)
not_3 = GateNot(A=values_68.Values)
not_4 = GateNot(A=values.Values)
path_2 = FilePath(panel)
c_script_28 = CSharpScript(x=not_2, y=not_3, z=not_4)  # -> A; inputs x: Boolean, y: Boolean, z: Boolean; same code as c_script_2
linkeractivator = BooleanToggle(True)
trigger = Trigger(Interval=250, TimerInterval=250, Target=sl)
lng = ListLength(List=demesh_2.Vertices)
sl = SimulatorLinker(SimulatorDirectory=path_2, Activator=linkeractivator, CountOfMeshVertices=lng)  # -> OutcomeTemperatureList, Time, MaxTemperature, MinTemperature
entwine_11 = Entwine(
    Branch00=sl.Time,
    Branch01=sl.OutcomeTemperatureList,
    Branch02=sl.MaxTemperature,
    Branch03=sl.MinTemperature,
    FlattenInputs=True)  # -> simplify(Result)
c_script_29 = CSharpScript(x=demesh_2.Vertices, y=demesh_4.Vertices)  # -> A; inputs x: list of Point3d, y: list of Point3d
# ---------- c_script_29: C# ----------
    List<bool> retlist = new List<bool>();
    for(int r = 0; r < x.Count; r++){
      bool mark = false;
      for(int i = 0; i < y.Count; i++){
        if(x[r] == y[i]){
          mark = true;
          break;
        }
      }
      retlist.Add(mark);
    }
    A = retlist;
# ---------- end c_script_29 ----------

# ---- group: display / step5
remove_records = Button()
c_script_30 = CSharpScript(x=path_2, y=values_3.Values)  # -> A; inputs x: String, y: String
# ---------- c_script_30: C# ----------
    string ret = string.Empty;
    ret = x + @"\Tempers\Temper" + y;
    A = ret;
# ---------- end c_script_30 ----------
c_script_31 = CSharpScript(x=remove_records, y=path_2)  # inputs x: Boolean, y: String
# ---------- c_script_31: C# ----------
    if(x){
      if(System.IO.Directory.Exists(y + @"\Tempers")){
        System.IO.DirectoryInfo di = new System.IO.DirectoryInfo(y + @"\Tempers");
        di.Delete(true);
      }
      if(System.IO.File.Exists(y + @"\log.txt"))
      {
        System.IO.File.Delete(y + @"\log.txt");
      }
    }
# ---------- end c_script_31 ----------
c_script_32 = CSharpScript(activator=not_2, x=c_script_30)  # -> Temperatures, Time, M, m; inputs activator: Boolean, x: String
# ---------- c_script_32: C# ----------
    if(activator) return;
    try{
      using(System.IO.StreamReader sr = new System.IO.StreamReader(x)){
        string a;
        List < double > retlist = new List<double>();
        //load time
        a = sr.ReadLine();
        Time = double.Parse(a);
        //
        while((a = sr.ReadLine()) != null){
          retlist.Add(double.Parse(a));
        }
        if(retlist.Count < 3) return;
        M = retlist[retlist.Count - 2];
        m = retlist[retlist.Count - 1];
        retlist.RemoveAt(retlist.Count - 1);
        retlist.RemoveAt(retlist.Count - 1);
        //
        Temperatures = retlist;
      }
    }
    catch{
    }
# ---------- end c_script_32 ----------
entwine_12 = Entwine(
    Branch00=c_script_32.Time,
    Branch01=c_script_32.Temperatures,
    Branch02=c_script_32.M,
    Branch03=c_script_32.m,
    FlattenInputs=True)  # -> simplify(Result)

# ---- group: display (continued)
c_script_33 = CSharpScript(x=not_2, y=entwine_11, z=entwine_12)  # -> A; inputs x: Boolean, y: tree, z: tree; same code as c_script_2
bang_16 = ExplodeTree(Data=c_script_33)  # -> Branch0, Branch1, Branch2, Branch3

# ---- group: step4
time = Panel(bang_16.Branch0)
all_temperatures = Panel(bang_16.Branch1)
item_8 = ListItem(List=all_temperatures, Index=cp.CPIndex, Wrap=True)
checkpoint_temperature = Panel(item_8)

# ---- group: display / unpainted color
gradient_5 = Gradient(LowerLimit=values_20.Values, UpperLimit=values_19.Values, Parameter=bang_16.Branch1, stops=[0: RGB(255, 255, 255)])

# ---- group: display
gradient_6 = Gradient(
    LowerLimit=bang_16.Branch3,
    UpperLimit=bang_16.Branch2,
    Parameter=bang_16.Branch1,
    stops=[0: RGB(5, 6, 28), 0.074: RGB(73, 15, 140), 0.294: RGB(243, 33, 169), 0.466: RGB(255, 34, 22), 0.71: RGB(255, 248, 111), 1: RGB(255, 255, 255)])

# ---- group: display / painted color
gradient_7 = Gradient(
    LowerLimit=values_17.Values,
    UpperLimit=values_18.Values,
    Parameter=bang_16.Branch1,
    stops=[0: RGB(234, 38, 0), 1: RGB(255, 255, 255)])

# ---- group: display (continued)
sic = SimulatorClassifier(PaintedColor=gradient_7, UnPaintedColor=gradient_5, PaintedMarker=c_script_29)
c_script_34 = CSharpScript(x=c_script_28, y=sic, z=gradient_6)  # -> A; inputs x: Boolean, y: tree, z: tree; same code as c_script_2
mcol = MeshColours(Mesh=c_script_2, Colours=c_script_34)
filter_3 = StreamFilter(Gate=bool_2, Stream1=mcol)
mesh_28 = Mesh(filter_3)

# ---- group: ui
number_slider_3 = Slider(60, range=0..100)
c_script_35 = CSharpScript(x=bang_16.Branch0)  # -> A; inputs x: Double
# ---------- c_script_35: C# ----------
    if(x < 0) A = 0;
    else A = x;
# ---------- end c_script_35 ----------
integer_division = IntegerDivision(A=c_script_35, B=number_slider_3)
mod = Modulus(A=c_script_35, B=number_slider_3)
c_script_36 = CSharpScript(x=integer_division, y=mod, z=bang_16.Branch3, u=bang_16.Branch2)  # -> out, A; inputs x: String, y: Double, z: Double, u: Double
# ---------- c_script_36: C# ----------
    string ret = "Time: " + x + "m" + y.ToString("0.0") + "s " + "\tMin:" + z.ToString("0.0") + "\tMax:" + u.ToString("0.0");
    A = ret;
# ---------- end c_script_36 ----------

# ----
path_3 = FilePath(panel)
c_script_37 = CSharpScript(x=path_3)  # -> A; inputs x: String
# ---------- c_script_37: C# ----------
    A = x + @"\icons\heatbar.PNG";
# ---------- end c_script_37 ----------
image = CreateImage(ImageSource=c_script_37, ImageWidth=Slider(450, range=0..1000), ImageHeight=Slider(50, range=0..1000))  # -> flatten(Image)
tb = CreateTextBlock(Text="Not simulating", TextSize=16, Justification=0)  # -> flatten(TextBlock)
merge_61 = Merge(Data1=tb, Data2=image)  # -> flatten(Result)
launchwin_3 = LaunchWindow(
    Show=bool_2,
    Name="Monitor",
    Width=Slider(364, range=0..1000),
    Height=Slider(131, range=0..1000),
    ChildStatus=2,
    EnableHorizScroll=False)
settextblock = SetTextBlockContents(TextBlockToModify=tb, NewTextBlockContents=c_script_36.A)
addelems_3 = AddElements(Window=launchwin_3, Elements=flatten(merge_61), DoVLChecking=True)  # -> AddedElements, ElementNames

# ==== cluster SplitMeshWithCurveOnMesh
curve_on_mesh = ClusterInput()
mesh = ClusterInput()
number_slider = Slider(2, range=0..10)
mesh_2 = Mesh(mesh)
crv = Curve(curve_on_mesh)
topoly = CurveToPolyline(Curve=crv, ToleranceDistance=Slider(0.2, range=0..1), ToleranceAngle=0)  # -> Polyline, Segments
pcol = PolylineCollapse(Polyline=topoly.Polyline, Tolerance=number_slider)  # -> Polyline, Count
divlength = DivideLength(Curve=pcol.Polyline, Length=number_slider)  # -> Points, Tangents, Parameters
cutting_thickness = ClusterInput()
lng = ListLength(List=divlength.Points)
wbloop = WeaverbirdsLoopSubdivision(MeshCurves=mesh_2, Level=1, SmoothNakedEdges=1)
subtraction = Subtraction(A=lng, B=1)
cull_i = CullIndex(List=divlength.Points, Indices=subtraction, Wrap=True)
meshcp = MeshClosestPoint(Point=cull_i, Mesh=wbloop)  # -> Point, Index, simplify(Parameter)
num = Number(cutting_thickness)
meval = MeshEval(Mesh=wbloop, Parameter=meshcp.Parameter)  # -> Point, Normal, Colour
line = LineSDL(Start=meval.Point, Direction=expr("-x", meval.Normal), Length=num)  # -> simplify(Line)
line_2 = LineSDL(Start=meval.Point, Direction=meval.Normal, Length=num)  # -> simplify(Line)
merge = Merge(Data1=graft(line_2), Data2=graft(line))  # -> simplify(Result)
join = JoinCurves(Curves=merge, Preserve=False)  # -> simplify(Curves)
trim = TrimTree(Tree=join, Depth=1)
flatten = FlattenTree(Tree=join, Path="{0}")
c_script = CSharpScript(x=trim, y=flatten)  # -> A; inputs x: tree, y: tree
# ---------- c_script: C# ----------
    if(x == null || x.BranchCount == 0) A = y;
    else A = x;
# ---------- end c_script ----------
paramloftmsh = ParameterLoftMesh(
    Sections=c_script,
    ParametersU=[0, 0.1, 0.2, 0.3, 0.4, 0.5, 0.6, 0.7, 0.8, 0.9, 1],
    ParametersV=[0, 0.25, 0.5, 0.75, 1],
    Weighted=False,
    Lengths=True,
    Angle=0,
    Closed=True,
    Triangulate=False)  # -> flatten(Lofted)
triremesh = TriRemesh(Geometry=paramloftmsh, Sharp=True, Iterations=25)  # -> Triangulation, Dual, Creases
msplit = MeshSplit(Mesh=mesh_2, Splitters=triremesh.Triangulation)
c_script_2 = CSharpScript(x=mesh_2, y=msplit, z=crv)  # -> A; inputs x: Mesh, y: Mesh, z: Curve
# ---------- c_script_2: C# ----------
    if(z == null || y == null){
      A = x;
    }
    else{
      A = y;
    }
# ---------- end c_script_2 ----------
mesh_3 = Mesh(c_script_2)
mesh_4 = ClusterOutput(mesh_3)

# ==== cluster DifferenceMethod
carve_surface_mesh = ClusterInput()
channel_depth = ClusterInput()
guidelines = ClusterInput()
wall_width = ClusterInput()
switch = ClusterInput()
number_slider = Slider(0.5, range=0..1)
bool = Boolean(switch)
num = Number(wall_width)
num_2 = Number(channel_depth)
data = Data(guidelines)
data_2 = Data(carve_surface_mesh)
cluster = Cluster(M=data_2, relay=data, A=num, A_2=num_2, bool=bool)  # -> O, M_2
addition = Addition(A=num_2, B=number_slider)
gate = StreamGate(Stream=data, Gate=bool)  # -> Target0, Target1
offmsh = OffsetMesh(Mesh=data_2, Distance=expr("-x", number_slider), BothSides=expr("-x", addition), CreateSolid=True)
data_3 = Data(gate.Target1)
data_4 = Data(offmsh)
twnconcrvs = TweenConsecutiveCurves(Curves=data_3, Factor=0.5, Loopback=False, InterpolationType=0, Refit=0, PointSample=0)
data_5 = Data(cluster.O)
mdif = MeshDifference(MeshesA=offmsh, MeshesB=flatten(cluster.O))
cull = CullPattern(List=twnconcrvs, CullPattern=[True, False])
cull_2 = CullPattern(List=twnconcrvs, CullPattern=[False, True])
channel_mesh = ClusterOutput(mdif)
lng = ListLength(List=data_3)
flip = FlipCurve(Curve=cull)  # -> Curve, Flag
equals = Equality(FirstNumber=lng, SecondNumber=Slider(1, range=0..1))  # -> Equality, Inequality
weave = Weave(Pattern=[0, 1], Stream0=flip.Curve, Stream1=cull_2, NullGaps=False)
number_slider_2 = Slider(3, range=0..10)
ext = ExtendCurve(Curve=weave, Type=0, Start=number_slider_2, End=number_slider_2)
divlength = DivideLength(Curve=ext, Length=Slider(1, range=0..1))  # -> Points, Tangents, Parameters
data_6 = Data(flatten(divlength.Points))
pline = PolyLine(Vertices=data_6, Closed=False)
filter = StreamFilter(Gate=equals.Equality, Stream0=pline, Stream1=data_3)
filter_2 = StreamFilter(Gate=equals.Equality, Stream0=weave, Stream1=data_3)
divlength_2 = DivideLength(Curve=filter_2, Length=Slider(1, range=0..1))  # -> Points, Tangents, Parameters
data_7 = Data(flatten(divlength_2.Points))
crv_cp = CurveClosestPoint(Point=data_7, Curve=filter)  # -> Point, Parameter, Distance
data_8 = Data(graft(crv_cp.Point))
pframe = PerpFrame(Curve=filter, Parameter=crv_cp.Parameter)
pcx = CurvePlane(Curve=filter, Plane=pframe)  # -> Points, ParamsC, ParamsP
dist = Distance(PointA=pcx.Points, PointB=data_8)
sort = SortList(Keys=dist, ValuesA=pcx.Points)  # -> Keys, ValuesA
item = ListItem(List=sort.ValuesA, Index=0, Wrap=True)  # -> Item, Item1
item_2 = ListItem(List=sort.Keys, Index=0, Wrap=True)  # -> Item, Item1
data_9 = Data(crv_cp.Point)
ln = Line(StartPoint=item.Item1, EndPoint=data_8)
pline_2 = PolyLine(Vertices=data_9, Closed=False)
data_10 = Data(flatten(item_2.Item1))
multiplication = Multiplication(A=data_10, B=num_2)
subtraction = Subtraction(A=data_10, B=0.5)
division = Division(A=subtraction, B=2)
entwine = Entwine(Branch00=pline_2, Branch01=subtraction, Branch02=multiplication, FlattenInputs=True)
msphere = MeshSphere(Base=data_9, Radius=division, UCount=10, VCount=20)
R = ClusterOutput(entwine)

# ==== cluster IntersectionMethodDynamicDiameter
carve_solid_mesh = ClusterInput()
carve_step_length = ClusterInput()
channel_depth = ClusterInput()
guidelines = ClusterInput()
wall_width = ClusterInput()
switch = ClusterInput()
num = Number(wall_width)
num_2 = Number(channel_depth)
bool = Boolean(switch)
mesh = Mesh(carve_solid_mesh)
data = Data(guidelines)
num_3 = Number(carve_step_length)
carve_mesh = CarveMesh(relay=mesh, S=data, num=num_2, num_2=num, num_3=num_3, bool=bool)  # -> data_5, R
offmsh = OffsetMesh(Mesh=mesh, Distance=expr("-x", Slider(0.5, range=0..1)), BothSides=0, CreateSolid=False)
data_2 = Data(carve_mesh.data_5)
mint = MeshIntersection(MeshesA=carve_mesh.data_5, MeshesB=offmsh)
channel_mesh = ClusterOutput(mint)
channel_data = ClusterOutput(carve_mesh.R)

# ==== cluster IntersectionMethodFixedDiameter
guideline = ClusterInput()
channel_diameter = ClusterInput()
switch = ClusterInput()
carve_solid_mesh = ClusterInput()
bool = Boolean(switch)
num = Number(channel_diameter)
division = Division(A=num, B=2)
gate = StreamGate(Stream=guideline, Gate=bool)  # -> Target0, Target1
mpipe = MeshPipe(Curve=gate.Target1, Radius=division, Accuracy=0.2, Rotation=0, Segments=10, Caps=2)
wbcatmullclark = WeaverbirdsCatmullClarkSubdivision(MeshCurves=mpipe, Level=Slider(2, range=0..10), SmoothNakedEdges=1)
sqr = Square(Value=division)
pi = Pi(Factor=1)
offmsh = OffsetMesh(Mesh=carve_solid_mesh, Distance=expr("-x", Slider(0.5, range=0..1)), BothSides=0, CreateSolid=False)
multiplication = Multiplication(A=sqr, B=pi)
divlength = DivideLength(Curve=guideline, Length=Slider(1, range=0..1))  # -> Points, Tangents, Parameters
division_2 = Division(A=multiplication, B=2)
lng = ListLength(List=divlength.Points)
pline = PolyLine(Vertices=divlength.Points, Closed=False)
mint = MeshIntersection(MeshesA=offmsh, MeshesB=wbcatmullclark)
dup = DuplicateData(Data=num, Number=lng, Order=True)
dup_2 = DuplicateData(Data=division_2, Number=lng, Order=True)
channel_mesh = ClusterOutput(mint)
entwine = Entwine(Branch00=pline, Branch01=dup, Branch02=dup_2, FlattenInputs=True)
R = ClusterOutput(entwine)

# ==== cluster Cluster_2
relay = ClusterInput()
relay_2 = ClusterInput()
item = ListItem(List=relay, Index=0, Wrap=True)  # -> Item2, Item1, Item
meshcp = MeshClosestPoint(Point=item.Item1, Mesh=relay_2)  # -> Point, Index, Parameter
meval = MeshEval(Mesh=relay_2, Parameter=meshcp.Parameter)  # -> Point, Normal, Colour
ln = Line(StartPoint=item.Item2, EndPoint=meshcp.Point)
vdis = VectorDisplay(Anchor=meshcp.Point, Vector=meval.Normal)
cull_i = CullIndex(List=relay, Indices=-1, Wrap=True)
vec = Vector(ln)
merge = Merge(Data1=flatten(item.Item2), Data2=flatten(meshcp.Point))
pline = PolyLine(Vertices=cull_i, Closed=False)
l0 = ClusterInput()
relay_3 = ClusterInput()
intcrv_t = InterpolateT(Vertices=merge, TangentStart=vec, TangentEnd=meval.Normal, KnotStyle=1)  # -> Curve, Length, Domain
merge_2 = Merge(Data1=flatten(pline), Data2=flatten(intcrv_t.Curve))
join = JoinCurves(Curves=merge_2, Preserve=False)
line = LineSDL(Start=meshcp.Point, Direction=meval.Normal, Length=relay_3)
ext = ExtendCurve(Curve=join, Type=0, Start=expr("-x", l0), End=relay_3)
ext_2 = ExtendCurve(Curve=line, Type=0, Start=Slider(2, range=0..10), End=Slider(0, range=0..100))
C = ClusterOutput(ext)
C_2 = ClusterOutput(ext_2)

# ==== cluster LinearLines
carve_surface_mesh = ClusterInput()
guideline = ClusterInput()
flip = ClusterInput()
interval = ClusterInput()
mesh = Mesh(carve_surface_mesh)
crv = Curve(guideline)
number_slider = Slider(2, range=0..10)
bool = Boolean(flip)
num = Number(interval)
topoly = CurveToPolyline(Curve=crv, ToleranceDistance=Slider(0.2, range=0..1), ToleranceAngle=0)  # -> Polyline, Segments
pcol = PolylineCollapse(Polyline=topoly.Polyline, Tolerance=number_slider)  # -> Polyline, Count
divlength = DivideLength(Curve=pcol.Polyline, Length=number_slider)  # -> Points, Tangents, Parameters
meshcp = MeshClosestPoint(Point=divlength.Points, Mesh=mesh)  # -> Point, Index, Parameter
grow_length = ClusterInput()
resolution = ClusterInput()
nurbs = NurbsCurve(Vertices=meshcp.Point, Degree=3, Periodic=False)  # -> Curve, Length, Domain
divlength_2 = DivideLength(Curve=nurbs.Curve, Length=num)  # -> Points, Tangents, Parameters
start_trim_length = ClusterInput()
end_extend_length = ClusterInput()
num_2 = Number(resolution)
num_3 = Number(grow_length)
pframe = PerpFrame(Curve=nurbs.Curve, Parameter=divlength_2.Parameters)
sec = MeshPlane(Mesh=mesh, Plane=pframe)
crv_cp = CurveClosestPoint(Point=graft(divlength_2.Points), Curve=sec)  # -> Point, Parameter, Distance
smaller = SmallerThan(FirstNumber=crv_cp.Distance, SecondNumber=Slider(0.5, range=0..1))  # -> SmallerThan, OrEqualTo
dispatch = Dispatch(List=sec, DispatchPattern=smaller.SmallerThan)  # -> ListA, ListB
data = Data(dispatch.ListA)
crvlenat = CurveLengthAt(Curve=dispatch.ListA, Point=graft(divlength_2.Points), Normalized=False)  # -> Length, Parameter
c_script = CSharpScript(routes=flatten(dispatch.ListA), rootPosition=flatten(crvlenat.Length), growLength=num_3, resolution=num_2)  # -> out, A, B; inputs routes: list of Curve, rootPosition: list of Double, growLength: Double, resolution: Double
# ---------- c_script: C# ----------
int count = routes.Count;
List<double> totalLength = new List<double>();
List<double> startLength = new List<double>();
List<double> endLength = new List<double>();
List<bool> isGrowingBackward = new List<bool>();
List<bool> isGrowingForward = new List<bool>();
List<Curve> growCurves = new List<Curve>();

double growStepLength = resolution;

const double intersection_tolerance = 0.001;
const double overlap_tolerance = 0.0;

List<Curve> r = new List<Curve>();

for(int i = 0; i < count; i++){
    totalLength.Add(routes[i].GetLength());
    startLength.Add(rootPosition[i]);
    endLength.Add(rootPosition[i]);
    isGrowingBackward.Add(true);
    isGrowingForward.Add(true);
    growCurves.Add(null);
}

int iterationMaxTime = 200;
int iterationTime = 0;
for(iterationTime = 0; iterationTime < iterationMaxTime; iterationTime++){
    //finish condition
    bool isGrowing = false;
    for(int j = 0; j < count; j++){
        if(isGrowingForward[j] || isGrowingBackward[j]){
            isGrowing = true;
            break;
        }
    }
    if(!isGrowing) break;

    //growing
    for(int j = 0; j < count; j++){
        if(isGrowingBackward[j]){
            //exceed?
            if(startLength[j]-growStepLength<0 || rootPosition[j]-startLength[j]+growStepLength>growLength){
                isGrowingBackward[j] = false;
            }
            else{
                //get segment
                Curve probeSegment = TrimCurveLength(routes[j], startLength[j]-growStepLength, startLength[j]);

                //check intersection
                bool isIntersected = false;
                for(int k = 0; k < count; k++){
                    if(k==j) continue;
                    else{
                        if(growCurves[k]!=null){
                            var events = Rhino.Geometry.Intersect.Intersection.CurveCurve(probeSegment, growCurves[k], intersection_tolerance, overlap_tolerance);
                            if(events.Count != 0){
                                isIntersected = true;
                                break;
                            }
                        }
                    }

                }

                //continue/stop
                if(isIntersected){
                    isGrowingBackward[j] = false;
                }
                else{
                    startLength[j] = startLength[j]-growStepLength;
                    growCurves[j] = TrimCurveLength(routes[j], startLength[j], endLength[j]);
                }
            }
        }

        if(isGrowingForward[j]){
            //exceed?
            if(endLength[j]+growStepLength>totalLength[j] || endLength[j]+growStepLength-rootPosition[j]>growLength){
                isGrowingForward[j] = false;
            }
            else{
                //get segment
                Curve probeSegment = TrimCurveLength(routes[j], endLength[j], endLength[j]+growStepLength);

                //check intersection
                bool isIntersected = false;
                for(int k = 0; k < count; k++){
                    if(k==j) continue;
                    else{
                        if(growCurves[k]!=null){
                            var events = Rhino.Geometry.Intersect.Intersection.CurveCurve(probeSegment, growCurves[k], intersection_tolerance, overlap_tolerance);
                            if(events.Count != 0){
                                isIntersected = true;
                                break;
                            }
                        }
                    }

                }

                //continue/stop
                if(isIntersected){
                    isGrowingForward[j] = false;
                }
                else{
                    endLength[j] = endLength[j]+growStepLength;
                    growCurves[j] = TrimCurveLength(routes[j], startLength[j], endLength[j]);
                }
            }
        }
    }
}
A = growCurves;
B = iterationTime;
# ---------- c_script: C# additional code ----------
public Curve TrimCurveLength(Curve curve, double startLength, double endLength){
    double startParameter;
    double endParameter;
    curve.LengthParameter(startLength, out startParameter);
    curve.LengthParameter(endLength, out endParameter);
    Curve newCurve = curve.Trim(startParameter, endParameter);
    return newCurve;
}
# ---------- end c_script ----------
cull = CullPattern(List=c_script.A, CullPattern=[True, False])
cull_2 = CullPattern(List=c_script.A, CullPattern=[False, True])
flip_2 = FlipCurve(Curve=cull_2)  # -> Curve, Flag
flip_3 = FlipCurve(Curve=cull)  # -> Curve, Flag
paramloftmsh = ParameterLoftMesh(
    Sections=c_script.A,
    ParametersU=[0, 0.1, 0.2, 0.3, 0.4, 0.5, 0.6, 0.7, 0.8, 0.9, 1],
    ParametersV=[0, 0.25, 0.5, 0.75, 1],
    Weighted=False,
    Lengths=False,
    Angle=0,
    Closed=False,
    Triangulate=False)
filter = StreamFilter(Gate=bool, Stream0=flip_3.Curve, Stream1=cull)
filter_2 = StreamFilter(Gate=bool, Stream0=cull_2, Stream1=flip_2.Curve)
weave = Weave(Pattern=[0, 1], Stream0=filter, Stream1=filter_2, NullGaps=False)
ext = ExtendCurve(Curve=weave, Type=0, Start=expr("-x", start_trim_length), End=end_extend_length)
loft_mesh = ClusterOutput(paramloftmsh)
cull_3 = CullPattern(List=ext, CullPattern=[True, False])
cull_4 = CullPattern(List=ext, CullPattern=[False, True])
flip_4 = FlipCurve(Curve=cull_3)  # -> Curve, Flag
weave_2 = Weave(Pattern=[0, 1], Stream0=flip_4.Curve, Stream1=cull_4, NullGaps=False)
array_spline = ClusterOutput(weave_2)

# ==== cluster SpiralLine
carve_surface_mesh = ClusterInput()
iteration_times = ClusterInput()
flip_guideline = ClusterInput()
interval = ClusterInput()
guideline = ClusterInput()
num = Number(interval)
crv = Curve(guideline)
bool = Boolean(flip_guideline)
mesh = Mesh(carve_surface_mesh)
int = Integer(iteration_times)
pcol = PolylineCollapse(Polyline=crv, Tolerance=Slider(2, range=0..10))  # -> Polyline, Count
wbloop = WeaverbirdsLoopSubdivision(MeshCurves=mesh, Level=1, SmoothNakedEdges=1)
cp = ControlPoints(Curve=pcol.Polyline)  # -> Points, Weights, Knots
cull_i = CullIndex(List=cp.Points, Indices=Slider(0, range=0..100), Wrap=True)
number_slider = Slider(1, range=0..1)
nurbs = NurbsCurve(Vertices=cull_i, Degree=3, Periodic=True)  # -> flatten(Curve), Length, Domain
flip = FlipCurve(Curve=nurbs.Curve)  # -> Curve, Flag
filter = StreamFilter(Gate=bool, Stream0=nurbs.Curve, Stream1=flip.Curve)
addition = Addition(A=number_slider, B=1)
addition_2 = Addition(A=addition, B=1)
larger = LargerThan(FirstNumber=int, SecondNumber=number_slider)  # -> LargerThan, OrEqualTo
addition_3 = Addition(A=addition_2, B=1)
addition_4 = Addition(A=addition_3, B=1)
addition_5 = Addition(A=addition_4, B=1)
addition_6 = Addition(A=addition_5, B=1)
addition_7 = Addition(A=addition_6, B=1)
addition_8 = Addition(A=addition_7, B=1)
addition_9 = Addition(A=addition_8, B=1)
larger_2 = LargerThan(FirstNumber=int, SecondNumber=addition_2)  # -> LargerThan, OrEqualTo
larger_3 = LargerThan(FirstNumber=int, SecondNumber=addition_3)  # -> LargerThan, OrEqualTo
gate = StreamGate(Stream=filter, Gate=larger.OrEqualTo)  # -> Target0, Target1
larger_4 = LargerThan(FirstNumber=int, SecondNumber=addition)  # -> LargerThan, OrEqualTo
larger_5 = LargerThan(FirstNumber=int, SecondNumber=addition_4)  # -> LargerThan, OrEqualTo
larger_6 = LargerThan(FirstNumber=int, SecondNumber=addition_5)  # -> LargerThan, OrEqualTo
larger_7 = LargerThan(FirstNumber=int, SecondNumber=addition_6)  # -> LargerThan, OrEqualTo
larger_8 = LargerThan(FirstNumber=int, SecondNumber=addition_7)  # -> LargerThan, OrEqualTo
larger_9 = LargerThan(FirstNumber=int, SecondNumber=addition_8)  # -> LargerThan, OrEqualTo
larger_10 = LargerThan(FirstNumber=int, SecondNumber=addition_9)  # -> LargerThan, OrEqualTo
cluster = Cluster_5(crv=gate.Target1, mesh=wbloop, num=num)
gate_2 = StreamGate(Stream=cluster, Gate=larger_4.OrEqualTo)  # -> Target0, Target1
cluster_2 = Cluster_5(crv=gate_2.Target1, mesh=wbloop, num=num)
gate_3 = StreamGate(Stream=cluster_2, Gate=larger_2.OrEqualTo)  # -> Target0, Target1
cluster_3 = Cluster_5(crv=gate_3.Target1, mesh=wbloop, num=num)
gate_4 = StreamGate(Stream=cluster_3, Gate=larger_3.OrEqualTo)  # -> Target0, Target1
cluster_4 = Cluster_5(crv=gate_4.Target1, mesh=wbloop, num=num)
gate_5 = StreamGate(Stream=cluster_4, Gate=larger_5.OrEqualTo)  # -> Target0, Target1
cluster_5 = Cluster_5(crv=gate_5.Target1, mesh=wbloop, num=num)
gate_6 = StreamGate(Stream=cluster_5, Gate=larger_6.OrEqualTo)  # -> Target0, Target1
cluster_6 = Cluster_5(crv=gate_6.Target1, mesh=wbloop, num=num)
gate_7 = StreamGate(Stream=cluster_6, Gate=larger_7.OrEqualTo)  # -> Target0, Target1
cluster_7 = Cluster_5(crv=gate_7.Target1, mesh=wbloop, num=num)
gate_8 = StreamGate(Stream=cluster_7, Gate=larger_8.OrEqualTo)  # -> Target0, Target1
cluster_8 = Cluster_5(crv=gate_8.Target1, mesh=wbloop, num=num)
gate_9 = StreamGate(Stream=cluster_8, Gate=larger_9.OrEqualTo)  # -> Target0, Target1
cluster_9 = Cluster_5(crv=gate_9.Target1, mesh=wbloop, num=num)
gate_10 = StreamGate(Stream=cluster_9, Gate=larger_10.OrEqualTo)  # -> Target0, Target1
cluster_10 = Cluster_5(crv=gate_10.Target1, mesh=wbloop, num=num)
number_slider_2 = Slider(0, range=0..100)
merge = Merge(
    Data1=filter,
    Data2=cluster,
    Data3=cluster_2,
    Data4=cluster_3,
    Data5=cluster_4,
    Data6=cluster_5,
    Data7=cluster_6,
    Data8=cluster_7,
    Data9=cluster_8,
    Data10=cluster_9,
    Data11=cluster_10)
num_2 = Number(number_slider_2)
num_3 = Number(number_slider_2)
clean = CleanTree(RemoveNulls=True, RemoveInvalid=True, RemoveEmpty=False, Tree=merge)
cluster_11 = Cluster_4(C=clean, x_2=num_2, x=num_3)
spiral_spline = ClusterOutput(cluster_11)
data = Data(cluster_11)

# ==== cluster HelicalLine
relay = ClusterInput()
data = ClusterInput()
L = ClusterInput()
number_slider = Slider(0, range=0..100)
data_2 = Data(data)
ext = ExtendCurve(Curve=relay, Type=0, Start=number_slider, End=number_slider)
divlength = DivideLength(Curve=ext, Length=L)  # -> Points, Tangents, Parameters
pframe = PerpFrame(Curve=ext, Parameter=divlength.Parameters)
sec = MeshPlane(Mesh=data_2, Plane=pframe)

pcol = PolylineCollapse(Polyline=flatten(sec), Tolerance=Slider(1.5, range=0..10))  # -> Polyline, Count

alicrvseams = AlignCurveSeams(Curves=pcol.Polyline, Snap=False, Iterative=True)  # -> Aligned, Points, R
lng = ListLength(List=alicrvseams.Aligned)
subtraction = Subtraction(A=lng, B=Slider(1, range=0..10))
subtraction_2 = Subtraction(A=lng, B=Slider(2, range=0..10))
dom = ConstructDomain(DomainStart=Slider(1, range=0..1), DomainEnd=subtraction)
dom_2 = ConstructDomain(DomainStart=0, DomainEnd=subtraction_2)
subset = SubList(List=alicrvseams.Aligned, Domain=dom_2, Wrap=True)  # -> graft(List), Index
subset_2 = SubList(List=alicrvseams.Aligned, Domain=dom, Wrap=True)  # -> graft(List), Index
merge = Merge(Data1=subset.List, Data2=subset_2.List)  # -> simplify(Result)
number_slider_2 = Slider(30, range=0..100)
item = ListItem(List=merge, Index=0, Wrap=True)  # -> Item, Item1
range = Range(Domain=Domain(0, 1), Steps=number_slider_2)
tweencrv = TweenCurve(CurveA=item.Item, CurveB=item.Item1, Factor=range, BlendType=0)
dom_3 = ConstructDomain(DomainStart=0, DomainEnd=1)
crvdom = CurveDomain(Curve=tweencrv, Domain=dom_3)  # -> Curve, Domain
subtraction_3 = Subtraction(A=number_slider_2, B=1)
eval = EvaluateCurve(Curve=crvdom.Curve, Parameter=range)  # -> simplify(Point), Tangent, Angle
dom_4 = ConstructDomain(DomainStart=0, DomainEnd=subtraction_3)
item_2 = ListItem(List=flatten(eval.Point), Index=0, Wrap=True)  # -> Item1, Item
subset_3 = SubList(List=eval.Point, Domain=dom_4, Wrap=True)  # -> flatten(List), Index
merge_2 = Merge(Data1=subset_3.List, Data2=item_2.Item1)
nurbs = NurbsCurve(Vertices=merge_2, Degree=Slider(1, range=0..10), Periodic=False)  # -> Curve, Length, Domain
join = JoinCurves(Curves=nurbs.Curve, Preserve=False)
C = ClusterOutput(join)

# ==== cluster Cluster
bool = ClusterInput()
M = ClusterInput()
relay = ClusterInput()
A = ClusterInput()
bool_2 = Boolean(bool)
gate = StreamGate(Stream=relay, Gate=bool_2)  # -> Target0, Target1
lng = ListLength(List=gate.Target1)
subtraction = Subtraction(A=lng, B=1)
wbloop = WeaverbirdsLoopSubdivision(MeshCurves=M, Level=1, SmoothNakedEdges=1)
cull_i = CullIndex(List=gate.Target1, Indices=flatten([Slider(0, range=0..100), subtraction]), Wrap=True)
A_2 = ClusterInput()
addition = Addition(A=A_2, B=Slider(1.53, range=0..10))

pcol = PolylineCollapse(Polyline=gate.Target1, Tolerance=Slider(1.5, range=0..10))  # -> Polyline, Count
cp = ControlPoints(Curve=pcol.Polyline)  # -> Points, Weights, Knots
meshcp = MeshClosestPoint(Point=cp.Points, Mesh=wbloop)  # -> Point, Index, Parameter
meval = MeshEval(Mesh=wbloop, Parameter=meshcp.Parameter)  # -> Point, Normal, Colour
vdis = VectorDisplay(Anchor=meshcp.Point, Vector=meval.Normal)
multiplication = Multiplication(A=meval.Normal, B=addition)
multiplication_2 = Multiplication(A=meval.Normal, B=Slider(2, range=0..10))
neg = Negative(Value=multiplication)
move = Move(Geometry=cp.Points, Motion=neg)  # -> Geometry, Transform
pline = PolyLine(Vertices=move.Geometry, Closed=False)
smoothpline = SmoothPolyline(Polyline=pline, Strength=1, Times=1)
pcol_2 = PolylineCollapse(Polyline=smoothpline, Tolerance=Slider(1.1, range=0..10))  # -> Polyline, Count
move_2 = Move(Geometry=cp.Points, Motion=multiplication_2)  # -> Geometry, Transform
cp_2 = ControlPoints(Curve=pcol_2.Polyline)  # -> Points, Weights, Knots

pline_2 = PolyLine(Vertices=move_2.Geometry, Closed=False)
pline_3 = PolyLine(Vertices=cp_2.Points, Closed=False)
unflatten = UnflattenTree(Tree=flatten(pline_3), Guide=pline_2)
range = Range(Domain=Domain(0, 1), Steps=Slider(1, range=0..10))
merge = Merge(Data1=pline_2, Data2=unflatten)
paramloftmsh = ParameterLoftMesh(
    Sections=merge,
    ParametersU=[0, 0.1, 0.2, 0.3, 0.4, 0.5, 0.6, 0.7, 0.8, 0.9, 1],
    ParametersV=range,
    Weighted=False,
    Lengths=True,
    Angle=0,
    Closed=False,
    Triangulate=False)
division = Division(A=A, B=2)  # disabled
end = EndPoints(Curve=merge)  # -> Start, End; disabled
offmsh = OffsetMesh(Mesh=flatten(paramloftmsh), Distance=division, BothSides=expr("-x", division), CreateSolid=False)  # disabled
meshcp_2 = MeshClosestPoint(Point=end.Start, Mesh=paramloftmsh)  # -> Point, Index, Parameter; disabled
meshcp_3 = MeshClosestPoint(Point=end.End, Mesh=paramloftmsh)  # -> Point, Index, Parameter; disabled
meval_2 = MeshEval(Mesh=paramloftmsh, Parameter=meshcp_2.Parameter)  # -> Point, Normal, Colour; disabled
meval_3 = MeshEval(Mesh=paramloftmsh, Parameter=meshcp_3.Parameter)  # -> Point, Normal, Colour; disabled
division_2 = Division(A=A, B=2)
multiplication_3 = Multiplication(A=division, B=meval_2.Normal)  # disabled
multiplication_4 = Multiplication(A=division, B=meval_2.Normal)  # disabled
multiplication_5 = Multiplication(A=division, B=meval_3.Normal)  # disabled
multiplication_6 = Multiplication(A=division, B=meval_3.Normal)  # disabled
offmsh_2 = OffsetMesh(Mesh=flatten(paramloftmsh), Distance=division_2, BothSides=expr("-x", division_2), CreateSolid=True)
neg_2 = Negative(Value=multiplication_4)  # disabled
neg_3 = Negative(Value=multiplication_6)  # disabled
O = ClusterOutput(offmsh_2)
move_3 = Move(Geometry=meval_2.Point, Motion=multiplication_3)  # -> Geometry, Transform; disabled
move_4 = Move(Geometry=meval_2.Point, Motion=neg_2)  # -> Geometry, Transform; disabled
move_5 = Move(Geometry=meval_3.Point, Motion=multiplication_5)  # -> Geometry, Transform; disabled
move_6 = Move(Geometry=meval_3.Point, Motion=neg_3)  # -> Geometry, Transform; disabled
item = ListItem(List=move_3.Geometry, Index=0, Wrap=True)  # -> Item, Item1; disabled
item_2 = ListItem(List=move_4.Geometry, Index=0, Wrap=True)  # -> Item, Item1; disabled
item_3 = ListItem(List=move_5.Geometry, Index=0, Wrap=True)  # -> Item, Item1; disabled
item_4 = ListItem(List=move_6.Geometry, Index=0, Wrap=True)  # -> Item, Item1; disabled
ln = Line(StartPoint=item_2.Item, EndPoint=item_2.Item1)  # disabled
ln_2 = Line(StartPoint=item.Item, EndPoint=item.Item1)  # disabled
ln_3 = Line(StartPoint=item_4.Item, EndPoint=item_4.Item1)  # disabled
ln_4 = Line(StartPoint=item_3.Item, EndPoint=item_3.Item1)  # disabled
merge_2 = Merge(Data1=ln_2, Data2=ln)  # disabled
merge_3 = Merge(Data1=ln_4, Data2=ln_3)  # disabled
paramloftmsh_2 = ParameterLoftMesh(
    Sections=merge_2,
    ParametersU=[0, 0.1, 0.2, 0.3, 0.4, 0.5, 0.6, 0.7, 0.8, 0.9, 1],
    ParametersV=[0, 0.25, 0.5, 0.75, 1],
    Weighted=True,
    Lengths=True,
    Angle=0,
    Closed=False,
    Triangulate=False)  # disabled
paramloftmsh_3 = ParameterLoftMesh(
    Sections=merge_3,
    ParametersU=[0, 0.1, 0.2, 0.3, 0.4, 0.5, 0.6, 0.7, 0.8, 0.9, 1],
    ParametersV=[0, 0.25, 0.5, 0.75, 1],
    Weighted=True,
    Lengths=True,
    Angle=0,
    Closed=False,
    Triangulate=False)  # disabled
merge_4 = Merge(Data1=simplify(offmsh), Data2=simplify(paramloftmsh_2), Data3=simplify(paramloftmsh_3))  # disabled
mjoin = MeshJoin(Meshes=merge_4)  # disabled
M_2 = ClusterOutput(mjoin)  # disabled

# ==== cluster CarveMesh
num = ClusterInput()
num_2 = ClusterInput()
S = ClusterInput()
num_3 = ClusterInput()
bool = ClusterInput()
num_4 = Number(num)
num_5 = Number(num_2)
relay = ClusterInput()
bool_2 = Boolean(bool)
addition = Addition(A=num_4, B=num_5)
division = Division(A=addition, B=2)
gate = StreamGate(Stream=S, Gate=bool_2)  # -> Target0, Target1
pcol = PolylineCollapse(Polyline=gate.Target1, Tolerance=division)  # -> Polyline, Count
num_6 = Number(num_3)
cp = ControlPoints(Curve=pcol.Polyline)  # -> Points, Weights, Knots
nurbs = NurbsCurve(Vertices=cp.Points, Degree=3, Periodic=False)  # -> Curve, Length, Domain
divlength = DivideLength(Curve=nurbs.Curve, Length=num_6)  # -> Points, Tangents, Parameters
curvature = Curvature(Curve=nurbs.Curve, Parameter=divlength.Parameters)  # -> P, K, C
darc = DeconstructArc(Arc=curvature.C)  # -> BasePlane, Radius, Angle
data = Data(graft(divlength.Points))
pframe = PerpFrame(Curve=nurbs.Curve, Parameter=divlength.Parameters)
wbloop = WeaverbirdsLoopSubdivision(MeshCurves=relay, Level=1, SmoothNakedEdges=1)
pcx = CurvePlane(Curve=nurbs.Curve, Plane=pframe)  # -> Points, ParamsC, ParamsP
meshcp = MeshClosestPoint(Point=flatten(data), Mesh=wbloop)  # -> Point, Index, Parameter
dist = Distance(PointA=pcx.Points, PointB=data)
sort = SortList(Keys=dist, ValuesA=pcx.Points)  # -> Keys, ValuesA
meval = MeshEval(Mesh=wbloop, Parameter=meshcp.Parameter)  # -> Point, Normal, Colour
item = ListItem(List=sort.ValuesA, Index=0, Wrap=True)  # -> Item, Item1
item_2 = ListItem(List=sort.Keys, Index=0, Wrap=True)  # -> Item, Item1
devec = DeconstructVector(Vector=meval.Normal)  # -> XComponent, YComponent, ZComponent
ln = Line(StartPoint=item.Item1, EndPoint=data)
number_slider = Slider(10, range=0..30)
nblur = BlurNumbers(Numbers=devec.XComponent, Strength=0.5, Iterations=number_slider, Lock=True, Wrap=False)
xy = XYPlane(Origin=Point(0, 0, 0))
nblur_2 = BlurNumbers(Numbers=devec.YComponent, Strength=0.5, Iterations=number_slider, Lock=True, Wrap=False)
subtraction = Subtraction(A=item_2.Item1, B=num_5)
nblur_3 = BlurNumbers(Numbers=devec.ZComponent, Strength=0.5, Iterations=number_slider, Lock=True, Wrap=False)
division_2 = Division(A=subtraction, B=2)  # -> flatten(Result)
neg = Negative(Value=division)
vec = VectorXYZ(XComponent=nblur, YComponent=nblur_2, ZComponent=nblur_3)  # -> Vector, Length
dom = ConstructDomain(DomainStart=neg, DomainEnd=division)
dom_2 = ConstructDomain(DomainStart=Slider(0, range=0..100), DomainEnd=Slider(4, range=0..10))
pi = Pi(Factor=expr("-x", Slider(0.5, range=0..1)))
align = AlignPlane(Plane=pframe, Direction=vec.Vector)  # -> Plane, Angle
python = GhPythonScript(distance=division_2, curvature=darc.Radius, refRadius=division)  # -> flatten(out), flatten(widthRatio), flatten(heightRatio); inputs distance: list, curvature: list
# ---------- python: Python ----------
__author__ = "yutianyu"

import rhinoscriptsyntax as rs
import math
l = len(distance)
widthRatio = []
heightRatio = []
heightScaleBool = []
heightScaleLength = 5

for i in range(l):
    d = distance[i]
    c = curvature[i]
    
    temp = d
    # if temp > c: temp = c 
    wr = temp/refRadius
    widthRatio.append(wr)
    
    
    hr = 1
    temp = c/refRadius
    if temp < 1: 
        hr = temp*0.6
        heightScaleBool.append(True)
    else:
        heightScaleBool.append(False)
    heightRatio.append(hr)
    
for i in range(l):
    if heightScaleBool[i] == True:
        for j in range(heightScaleLength):
            if (i-j)>=0: heightRatio[i-j] = heightRatio[i-j] + (heightRatio[i] - heightRatio[i-j])*((heightScaleLength-j)/heightScaleLength)
            if (i+j)<l: heightRatio[i+j] = heightRatio[i+j] + (heightRatio[i] - heightRatio[i+j])*((heightScaleLength-j)/heightScaleLength)
# ---------- end python ----------
polygon = Polygon(Plane=xy, Radius=division, Segments=6, FilletRadius=0)  # -> Polygon, Length
rectangle = Rectangle(Plane=xy, XSize=dom, YSize=dom_2, Radius=0)  # -> Rectangle, Length
prot = RotatePlane(Plane=align.Plane, Angle=pi)
xy_2 = XYPlane(Origin=Point(0, 0, 0))
area = Area(Geometry=polygon.Polygon)  # -> Area, Centroid
orient = Orient(Geometry=polygon.Polygon, Source=xy_2, Target=prot)  # -> Geometry, Transform
orient_2 = Orient(Geometry=rectangle.Rectangle, Source=xy_2, Target=prot)  # -> Geometry, Transform
division_3 = Division(A=area.Area, B=2)
multiplication = Multiplication(A=division, B=2)
pline = PolyLine(Vertices=divlength.Points, Closed=False)
multiplication_2 = Multiplication(A=division_3, B=python.widthRatio)
multiplication_3 = Multiplication(A=python.widthRatio, B=multiplication)
scale_nu = ScaleNU(Geometry=orient.Geometry, Plane=prot, ScaleX=1, ScaleY=python.heightRatio, ScaleZ=1)  # -> Geometry, Transform
multiplication_4 = Multiplication(A=multiplication_2, B=python.heightRatio)
data_2 = Data(pline)
division_4 = Division(A=multiplication_3, B=2)
merge = Merge(Data1=graft(scale_nu.Geometry), Data2=graft(orient_2.Geometry))
runion = RegionUnion(Curves=merge)  # -> flatten(Result)
entwine = Entwine(Branch00=data_2, Branch01=multiplication_3, Branch02=multiplication_4, FlattenInputs=True)
msphere = MeshSphere(Base=divlength.Points, Radius=division_4, UCount=10, VCount=20)
data_3 = Data(prot)
scale_nu_2 = ScaleNU(Geometry=runion, Plane=prot, ScaleX=python.widthRatio, ScaleY=1, ScaleZ=1)  # -> Geometry, Transform
deplane = DeconstructPlane(Plane=data_3)  # -> Origin, XAxis, YAxis, ZAxis
neg_2 = Negative(Value=deplane.YAxis)
multiplication_5 = Multiplication(A=neg_2, B=Slider(0.5, range=0..1))
vdis = VectorDisplay(Anchor=data_3, Vector=multiplication_5)
move = Move(Geometry=scale_nu_2.Geometry, Motion=multiplication_5)  # -> Geometry, Transform
range = Range(Domain=Domain(0, 1), Steps=Slider(1, range=0..10))
paramloftmsh = ParameterLoftMesh(
    Sections=move.Geometry,
    ParametersU=[0, 0.1, 0.2, 0.3, 0.4, 0.5, 0.6, 0.7, 0.8, 0.9, 1],
    ParametersV=range,
    Weighted=True,
    Lengths=True,
    Angle=0,
    Closed=False,
    Triangulate=False)
clsmsh = CloseMesh(Mesh=paramloftmsh, Quadrangulate=True)  # -> Closed, Amount, Openings, R
data_4 = Data(clsmsh.Closed)
data_5 = ClusterOutput(data_4)
R = ClusterOutput(entwine)

# ==== cluster Cluster_4
C = ClusterInput()
alicrvseams = AlignCurveSeams(Curves=C, Seam=Slider(4.2, range=0..11), Snap=False, Iterative=True)  # -> Aligned, Points, R
rebcrv = RebuildCurve(Curve=alicrvseams.Aligned, EndTangents=False)
cluster = Cluster_3(relay=rebcrv)
number_slider = Slider(37, range=0..100)
range = Range(Domain=Domain(0, 1), Steps=number_slider)
item = ListItem(List=cluster, Index=0, Wrap=True)  # -> Item, Item1
tweencrv = TweenCurve(CurveA=item.Item, CurveB=item.Item1, Factor=range, BlendType=0)
dom = ConstructDomain(DomainStart=0, DomainEnd=1)
crvdom = CurveDomain(Curve=tweencrv, Domain=dom)  # -> Curve, Domain
subtraction = Subtraction(A=number_slider, B=1)
eval = EvaluateCurve(Curve=crvdom.Curve, Parameter=range)  # -> simplify(Point), Tangent, Angle
dom_2 = ConstructDomain(DomainStart=0, DomainEnd=subtraction)
item_2 = ListItem(List=flatten(eval.Point), Index=0, Wrap=True)  # -> Item1, Item
subset = SubList(List=eval.Point, Domain=dom_2, Wrap=True)  # -> flatten(List), Index
merge = Merge(Data1=subset.List, Data2=item_2.Item1)
x = ClusterInput()
x_2 = ClusterInput()
nurbs = NurbsCurve(Vertices=merge, Degree=Slider(1, range=0..10), Periodic=False)  # -> Curve, Length, Domain
neg = Negative(Value=x)
neg_2 = Negative(Value=x_2)
join = JoinCurves(Curves=nurbs.Curve, Preserve=False)
ext = ExtendCurve(Curve=join, Type=0, Start=neg_2, End=neg)
C_2 = ClusterOutput(ext)

# ==== cluster Cluster_5
mesh = ClusterInput()
mesh_2 = Mesh(mesh)
crv = ClusterInput()
crv_2 = Curve(crv)
num = ClusterInput()
divlength = DivideLength(Curve=crv_2, Length=Slider(2, range=0..10))  # -> Points, Tangents, Parameters
num_2 = Number(num)
meshcp = MeshClosestPoint(Point=divlength.Points, Mesh=mesh_2)  # -> Point, Index, Parameter
meval = MeshEval(Mesh=mesh_2, Parameter=meshcp.Parameter)  # -> Point, Normal, Colour
pframe = PerpFrame(Curve=crv_2, Parameter=divlength.Parameters)
addition = Addition(A=num_2, B=0.5)
align = AlignPlane(Plane=pframe, Direction=meval.Normal)  # -> Plane, Angle
division = Division(A=Slider(3, range=0..10), B=2)
dom = ConstructDomain(DomainStart=division, DomainEnd=expr("-x", division))
dom_2 = ConstructDomain(DomainStart=0, DomainEnd=addition)
rectangle = Rectangle(Plane=align.Plane, XSize=dom, YSize=dom_2, Radius=0)  # -> Rectangle, Length
mesh_uv = MeshSurface(Surface=rectangle.Rectangle, UCount=5, VCount=5, Overhang=True, Equalize=False)
mmx = MeshMesh(MeshA=mesh_uv, MeshB=mesh_2)
data = Data(flatten(mmx))
eval = EvaluateCurve(Curve=data, Parameter=Slider(0, range=0..100))  # -> Point, Tangent, Angle
dist = Distance(PointA=eval.Point, PointB=divlength.Points)
flip = FlipCurve(Curve=data)  # -> Curve, Flag
smaller = SmallerThan(FirstNumber=dist, SecondNumber=Slider(0.7, range=0..1))  # -> SmallerThan, OrEqualTo
python = GhPythonScript(flip=smaller.SmallerThan, x=flip.Curve, xf=data)  # -> out, a; inputs flip: list, x: list, xf: list
# ---------- python: Python ----------
__author__ = "yutianyu"

import rhinoscriptsyntax as rs
l = len(flip)
a = []
for i in range(l):
    if flip[i]:
        a.append(xf[i])
    else:
        a.append(x[i])
# ---------- end python ----------
data_2 = Data(flatten(python.a))
dom_3 = ConstructDomain(DomainStart=0, DomainEnd=1)
crvdom = CurveDomain(Curve=data_2, Domain=dom_3)  # -> Curve, Domain
eval_2 = EvaluateLength(Curve=crvdom.Curve, Length=num_2, Normalized=False)  # -> Point, Tangent, Parameter
pline = PolyLine(Vertices=eval_2.Point, Closed=False)
pcol = PolylineCollapse(Polyline=pline, Tolerance=Slider(2, range=0..10))  # -> Polyline, Count
cp = ControlPoints(Curve=pcol.Polyline)  # -> Points, Weights, Knots
nurbs = NurbsCurve(Vertices=cp.Points, Degree=3, Periodic=True)  # -> flatten(Curve), Length, Domain
C = ClusterOutput(nurbs.Curve)

# ==== cluster Cluster_3
relay = ClusterInput()
lng = ListLength(List=relay)
subtraction = Subtraction(A=lng, B=Slider(1, range=0..10))
subtraction_2 = Subtraction(A=lng, B=Slider(2, range=0..10))
dom = ConstructDomain(DomainStart=0, DomainEnd=subtraction_2)
dom_2 = ConstructDomain(DomainStart=Slider(1, range=0..1), DomainEnd=subtraction)
subset = SubList(List=relay, Domain=dom, Wrap=True)  # -> graft(List), Index
subset_2 = SubList(List=relay, Domain=dom_2, Wrap=True)  # -> graft(List), Index
merge = Merge(Data1=subset.List, Data2=subset_2.List)  # -> simplify(Result)
R = ClusterOutput(merge)
